# Grasshopper definition FacadeEmbed_JinQiao_Podium.gh (Grasshopper 1.0.7)
# plug-ins: EleFront, Wombat, TT Toolbox, Pufferfish, Hare, treesloth01

# ----
# 线段延长长度
number_slider = Slider(1001, range=0..10000)  # disabled

# ----
# remove duplicate curves
geo = Geometry()  # disabled
number_slider_2 = Slider(0.1, range=0..0.1)  # disabled
boundary = BoundarySurfaces(Edges=geo)  # disabled
area = Area(Geometry=boundary)  # -> Area, Centroid; disabled
cullduppoints = RemoveDuplicatePoints(InputPoints=area.Centroid, Tolerance=number_slider_2)  # -> OutputPoints, FirstPointIndexes; disabled
null = NullItem(Item=cullduppoints.FirstPointIndexes)  # -> NullFlags, InvalidFlags, Description; disabled
dispatch = Dispatch(List=boundary, DispatchPattern=null.NullFlags)  # -> ListA, ListB; disabled
geo_2 = Geometry(dispatch.ListA)  # disabled

# ----
# 调换阴阳角设定
toggle = BooleanToggle(False)  # disabled

# ----
# 按图层整理curves
# 2.Line-0-建筑
# 3.Line-1-结构
panel = Panel("Line-1-结构-Out")
reflay = ReferenceByLayer(LayerName="Line-0-建筑-Whole")
reflay_2 = ReferenceByLayer(LayerName="Line-1-檐口")
reflay_3 = ReferenceByLayer(LayerName="Line-1-结构-All")
reflay_4 = ReferenceByLayer(LayerName=panel)

# ----
# 1.按图层整理curves
# 1.Line-1-建筑-
panel_2 = Panel("Line-1-建筑-Whole")
reflay_5 = ReferenceByLayer(LayerName=panel_2)

# ----
# （3）导入局部单体建筑的参考线
# 按照图层导入建筑、结构、檐口线
panel_3 = Panel("Line-1-檐口-吊顶处理")
reflay_6 = ReferenceByLayer(LayerName=panel_3)
reflay_7 = ReferenceByLayer(LayerName="Line-1-檐口-车道等灰空间")
xy = XYPlane(Origin=Point(0, 0, 0))
xy_2 = XYPlane(Origin=Point(0, 0, 0))
xy_3 = XYPlane(Origin=Point(0, 0, 0))
xy_4 = XYPlane(Origin=Point(0, 0, 0))
xy_5 = XYPlane(Origin=Point(0, 0, 0))
xy_6 = XYPlane(Origin=Point(0, 0, 0))
xy_7 = XYPlane(Origin=Point(0, 0, 0))
project = Project(Geometry=reflay_5, Plane=xy)  # -> Geometry, Transform
project_2 = Project(Geometry=reflay, Plane=xy_2)  # -> Geometry, Transform
project_3 = Project(Geometry=reflay_2, Plane=xy_3)  # -> Geometry, Transform
project_4 = Project(Geometry=reflay_4, Plane=xy_4)  # -> Geometry, Transform
project_5 = Project(Geometry=reflay_3, Plane=xy_5)  # -> Geometry, Transform
project_6 = Project(Geometry=reflay_6, Plane=xy_6)  # -> Geometry, Transform
project_7 = Project(Geometry=reflay_7, Plane=xy_7)  # -> Geometry, Transform
crv = Curve(project.Geometry)
crv_2 = Curve(project_3.Geometry)
crv_3 = Curve(project_4.Geometry)
crv_4 = Curve(project_5.Geometry)
crv_5 = Curve(project_2.Geometry)
crv_6 = Curve(<curve referenced from the Rhino model>)
crv_7 = Curve(project_7.Geometry)
crv_8 = Curve(project_6.Geometry)

# ----
# Input Blocks (Correct Plan)
# 主体定位点
data = Data(["PX-GLAZ-F2$0$PX-GLAZ-F1$0$标准块", "PX-GLAZ-F2$0$PX-GLAZ-F2$0$标准块", "PX-GLAZ-F2$0$PX-GLAZ-F3$0$标准块"])

# ----
# Input Curves
# 主体定位点（按图层导入）
crv_9 = Curve(<curve referenced from the Rhino model>)

# ----
# Input Blocks (Wrong Plan)
# 主体定位点
data_2 = Data("PX-GLAZ-F2$0$T3T")

# ----
# （1）导入埋件定位点
# Block & Curve的形式
# block names
listblockd = ListBlockDocument()
panel_4 = Panel(listblockd)

# ----
# 按图层整理curves
# 1.导入建筑线：Arch_curve_
panel_5 = Panel("Arch_curve_smooth")
reflay_8 = ReferenceByLayer(LayerName="Arch_curve_Whole")
reflay_9 = ReferenceByLayer(LayerName=panel_5)
reflay_10 = ReferenceByLayer(LayerName="Arch_curve_withLocation")
reflay_11 = ReferenceByLayer(LayerName="Arch_curve_angular")

# ----
# 特殊建筑线
# This Project Only
panel_6 = Panel("Arch_curve_other")
reflay_12 = ReferenceByLayer(LayerName=panel_6)

# ----
# 1.输入block names
data_3 = Data(["PX-GLAZ-F2$0$PX-GLAZ-F2$0$fin", "PX-GLAZ-F2$0$PX-GLAZ-F1$0$fin"])
panel_7 = Panel(data_3)

# ----
# （0）Prep
# 检测Block的Plane
# Later:
# 1.Block -Plane-不同方向合并处理
# 
# 2.双层幕墙的处理
# block names
listblockd_2 = ListBlockDocument()
panel_9 = Panel(listblockd_2)
refblock = ReferenceBlockByName(BlockName=panel_7)
deblock = DeconstructBlock(Block=refblock)  # -> Name, Plane, Geometry

# ----
# 2.导入所有结构线
panel_10 = Panel("Structure_curve_all")
reflay_13 = ReferenceByLayer(LayerName=panel_10)

# ----
# 单体选型
list = ValueList({"板埋": 0, "槽埋": 1, "板槽埋": 2}, selected="槽埋")
list_2 = ValueList({"顶埋": 0, "侧埋": 1}, selected="顶埋")
panel_11 = Panel(list)
panel_12 = Panel(list_2)

layer = ObjectLayer(Guid=crv_9)  # -> LayerIndex, LayerPathName
panel_13 = Panel(data)
panel_15 = Panel(data_2)
panel_16 = Panel(layer.LayerPathName)
refblock_2 = ReferenceBlockByName(BlockName=panel_13)
refblock_3 = ReferenceBlockByName(BlockName=panel_15)
reflay_14 = ReferenceByLayer(LayerName=panel_16)
xy_8 = XYPlane(Origin=Point(0, 0, 0))
xy_9 = XYPlane(Origin=Point(0, 0, 0))
xy_10 = XYPlane(Origin=Point(0, 0, 0))
project_8 = Project(Geometry=refblock_3, Plane=xy_10)  # -> Geometry, Transform
project_9 = Project(Geometry=refblock_2, Plane=xy_9)  # -> Geometry, Transform
project_10 = Project(Geometry=reflay_14, Plane=xy_8)  # -> Geometry, Transform

# ----
# （2）导入整个site的参考线
# 按照图层导入所有的建筑、结构、檐口线
xy_11 = XYPlane(Origin=Point(0, 0, 0))
xy_12 = XYPlane(Origin=Point(0, 0, 0))
xy_13 = XYPlane(Origin=Point(0, 0, 0))
xy_14 = XYPlane(Origin=Point(0, 0, 0))
xy_15 = XYPlane(Origin=Point(0, 0, 0))
xy_16 = XYPlane(Origin=Point(0, 0, 0))
project_11 = Project(Geometry=reflay_8, Plane=xy_11)  # -> Geometry, Transform
project_12 = Project(Geometry=reflay_9, Plane=xy_12)  # -> Geometry, Transform
project_13 = Project(Geometry=reflay_10, Plane=xy_13)  # -> Geometry, Transform
project_14 = Project(Geometry=reflay_11, Plane=xy_14)  # -> Geometry, Transform
project_15 = Project(Geometry=reflay_12, Plane=xy_15)  # -> Geometry, Transform
project_16 = Project(Geometry=reflay_13, Plane=xy_16)  # -> Geometry, Transform
crv_10 = Curve(project_12.Geometry)
crv_11 = Curve(project_13.Geometry)
crv_12 = Curve(project_14.Geometry)
crv_13 = Curve(project_11.Geometry)
crv_14 = Curve(project_15.Geometry)
crv_15 = Curve(project_16.Geometry)

# ---- group: 混凝土
# 板埋几何INPUT
list_3 = ValueList({"C15": 0, "C20": 1, "C25": 2, "C30": 3, "C35": 4, "C40": 5}, selected="C35")

# ---- group: 钢筋牌号
list_4 = ValueList({"HPB300": 0, "HRB400": 1}, selected="HPB300")

# ---- group: 直径
list_5 = ValueList({"10": 0, "12": 1, "16": 2, "18": 3, "20": 4, "25": 5}, selected="12")

# ---- group: 列
list_6 = ValueList({"2X": 0, "3X": 1, "4X": 2}, selected="3X")

# ---- group: 行
list_7 = ValueList({"2Y": 0, "3Y": 1, "4Y": 2}, selected="2Y")

# ---- group: 锚筋间距
s_x = Slider(22, range=14..60, expression="X*5")
s_y = Slider(22, range=14..60, expression="X*5")

# ----
# 2.检测plane是否存在
pln = Plane(deblock.Plane)

# ----
# 槽埋-角部选择
list_8 = ValueList({"槽埋角部-L形": 0, "槽埋角部-I形": 1}, selected="槽埋角部-I形")

# ----
# 3.如果不存在则Blake geometry
# 并在rhino里面清理线段
geo_3 = Geometry(deblock.Geometry)

max = Maximum(A=s_x, B=s_y)
filter = StreamFilter(Gate=list_3, Stream0=7.2, Stream1=9.6, Stream2=11.9, Stream3=14.3, Stream4=16.7, Stream5=19.1)
filter_2 = StreamFilter(Gate=list_4, Stream0=270, Stream1=360)
filter_3 = StreamFilter(Gate=list_5, Stream0=10, Stream1=12, Stream2=16, Stream3=18, Stream4=20, Stream5=25)
filter_4 = StreamFilter(Gate=list_3, Stream0=0.91, Stream1=1.1, Stream2=1.27, Stream3=1.43, Stream4=1.57, Stream5=1.71)
filter_5 = StreamFilter(Gate=list_4, Stream0=0.16, Stream1=0.14)
addition = Addition(A=list_6, B=1)
addition_2 = Addition(A=list_7, B=1)
division = Division(A=max, B=8)
t = Integer(division)
panel_17 = Panel(filter_4)
panel_18 = Panel(filter)
panel_19 = Panel(filter_5)
min = Minimum(A=filter_2, B=300)
panel_20 = Panel(min)
expression = Expression(A=filter_5, fy=filter_2, ft=filter_4, d=filter_3, Expression="(int((0.6*1.1*A*fy/ft*d)/5)+1)*5")
crv_16 = Curve()
crv_17 = Curve([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])
crv_18 = Curve(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)
merge = Merge(Data1=crv_17, Data2=crv_18)

# ----
# 选要重塑的线段长度
number_slider_3 = Slider(1200, range=0..10000)

# ----
# 调整重塑线段的平滑度
number_slider_4 = Slider(11, range=0..11)

# ----
# 根据F2建筑线制作轮廓线
crv_19 = Curve(crv)
explode = Explode(Curve=crv_19, Recursive=True)  # -> Segments, Vertices
len = Length(Curve=explode.Segments)
sort = SortList(Keys=len)  # -> Keys, ValuesA
larger = LargerThan(FirstNumber=len, SecondNumber=number_slider_3)  # -> LargerThan, OrEqualTo
panel_21 = Panel(sort.Keys)
dispatch_2 = Dispatch(List=explode.Segments, DispatchPattern=larger.LargerThan)  # -> ListA, ListB
data_4 = Data(dispatch_2.ListA)
data_5 = Data(dispatch_2.ListB)
join = JoinCurves(Curves=data_5, Preserve=False)
disc = Discontinuity(Curve=join, Level=1)  # -> Points, Parameters
nurbs = NurbsCurve(Vertices=disc.Points, Degree=number_slider_4, Periodic=False)  # -> flatten(Curve), Length, Domain
join_2 = JoinCurves(Curves=flatten([data_4, nurbs.Curve]), Preserve=False)
offset = OffsetCurve(Curve=join_2, Distance=Slider(6859, range=0..10000), Corners=1)

# ----
# Default Curve
reb = RebuildCurve(Curve=offset, Count=Slider(17, range=0..100), Tangents=invert(False))

# ----
# InputCurve
crv_20 = Curve()

# ----
# Curve-框住要分析的建筑单体
# 如果要用自己导入Curve作为分析线，
# 请在InputCurve那里导入curve,
# 然后在上方的选型列表选择Input Curve。
# 
# 如果要用Grasshopper自动生成的Curve,
# 请在上方的选型列表选择Default Curve。
list_9 = ValueList({"Default Curve": 0, "Input Curve": 1}, selected="Default Curve")
filter_6 = StreamFilter(Gate=list_9, Stream0=reb, Stream1=crv_20)

# ----
# 梁宽根据tag
number_slider_5 = Slider(150, range=0..1000)

# ----
# 区分内外梁边线-精确offset还没加
crv_21 = Curve(crv_4)
crv_22 = Curve(filter_6)
offcrv = OffsetCurve(
    Curve=crv_21,
    Plane=PlaneXY(0, 0, 0),
    Distance=number_slider_5,
    BothSides=expr("-x", number_slider_5),
    Kinks=0,
    CapType="0")
midpt = CurveMiddle(Curve=offcrv)
midpt_2 = CurveMiddle(Curve=crv_21)
crv_23 = Curve(offcrv)
item = ListItem(List=midpt, Index=0, Wrap=True)
item_2 = ListItem(List=crv_23, Index=0, Wrap=True)
item_3 = ListItem(List=crv_23, Index="-1", Wrap=True)
pull = PullPoint(Point=midpt_2, Geometry=crv_22, ClosestOnly=True)  # -> ClosestPoint, Distance
ln = Line(StartPoint=item, EndPoint=graft(pull.ClosestPoint))
graft = GraftTree(Tree=crv_21, IncludeEmptyLists=True, IncludeNullItems=True)
ccx = CurveCurve(CurveA=ln, CurveB=graft)  # -> Points, ParamsA, ParamsB
null_2 = NullItem(Item=ccx.Points)  # -> NullFlags, InvalidFlags, Description
dispatch_3 = Dispatch(List=item_3, DispatchPattern=null_2.InvalidFlags)  # -> ListA, ListB
dispatch_4 = Dispatch(List=item_2, DispatchPattern=null_2.InvalidFlags)  # -> ListA, ListB

# ----
# 梁边线-内
merge_2 = Merge(Data1=dispatch_4.ListB, Data2=dispatch_3.ListA)

# ----
# 梁边线-外
merge_3 = Merge(Data1=dispatch_4.ListA, Data2=dispatch_3.ListB)

# ----
# 埋件向外探索最远出的梁的距离
number_slider_6 = Slider(5000, range=0..10000)

# ----
# 撞到结构交点Offset
number_slider_7 = Slider(450, range=0..1000)

# ----
# 1.0无檐口线+上下层幕墙边线连续
# 01：钢板焊埋件[钢梁外侧]
# @钢边梁宽@钢边梁高
list_10 = ValueList({"优化定位": 0, "Default定位": 1}, selected="优化定位")

# ----
# 是否有吊顶：
# 下层幕墙边线在结构边梁以内>350
# 
# （最外层结构线）
number_slider_8 = Slider(350, range=0..1000)

crv_24 = Curve(crv_5)

# ----
# 2.2下层建筑边线内侧300-600mm范围内
number_slider_9 = Slider(600, range=0..1000)
crv_25 = Curve(crv_24)
offset_2 = OffsetCurve(Curve=crv_25, Distance=expr("-x", Slider(300, range=0..1000)), Corners=1)
offset_3 = OffsetCurve(Curve=crv_25, Distance=expr("-x", number_slider_9), Corners=1)

# ----
# 2.1下层建筑边线外侧50-350mm范围内
number_slider_10 = Slider(350, range=0..1000)
crv_26 = Curve(crv_24)
offset_4 = OffsetCurve(Curve=crv_26, Distance=Slider(50, range=0..100), Corners=1)
offset_5 = OffsetCurve(Curve=crv_26, Distance=number_slider_10, Corners=1)

# ----
# 下层建筑内侧到300到外侧50内
# 有钢结构
number_slider_11 = Slider(50, range=0..1000)
crv_27 = Curve(crv_24)
offset_6 = OffsetCurve(Curve=crv_27, Distance=expr("-x", Slider(300, range=0..1000)), Corners=1)
offset_7 = OffsetCurve(Curve=crv_27, Distance=number_slider_11, Corners=1)

# ----
# Sort Text
panel_22 = Panel("""T2-PLAN-F2$0$次梁编号
T2-PLAN-F2$0$框梁编号""")
reflay_15 = ReferenceByLayer(LayerName=panel_22)  # -> flatten(Geometry)
panel_23 = Panel("""GL3-1
GL4-1
GL5-1
GL5-2
GL6-1
GL6-2
GKL6-2
GL7-1
GL7-2
GKL7-1
GL8-1
GL8-2
GKl7-1
GKl7-4
GKL9-2
GL10-1
GL10-4
GKL10-2
GKL10-4
GL12-1""")
detext = DeconstructText(TextObject=reflay_15)  # -> Text, Plane, Height, Justification
lng = ListLength(List=detext.Text)
tmatch = MatchText(Text=detext.Text, Pattern=graft(panel_23), Case=True)
tsort = SortText(Keys=detext.Text, Culture=127)  # -> Keys, Values
pt = Point(detext.Plane)
dispatch_5 = Dispatch(List=reflay_15, DispatchPattern=tmatch)  # -> ListA, ListB
panel_24 = Panel(lng)
panel_25 = Panel(tsort.Keys)
data_6 = Data(dispatch_5.ListA)
bang = ExplodeTree(Data=data_6)  # -> Branch0, Branch1, Branch2, Branch3, Branch4, Branch5, Branch6, Branch7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
flatten = FlattenTree(Tree=data_6, Path="{0}")
lng_2 = ListLength(List=flatten)
equals = Equality(FirstNumber=panel_24, SecondNumber=lng_2)  # -> Equality, Inequality
filter_7 = StreamFilter(Gate=equals.Equality, Stream0="Missing Text!", Stream1="Correct!")
panel_26 = Panel(filter_7)
detext_2 = DeconstructText(TextObject=bang.Branch0)  # -> Text, Plane, Height, Justification
detext_3 = DeconstructText(TextObject=bang.Branch1)  # -> Text, Plane, Height, Justification
detext_4 = DeconstructText(TextObject=bang.Branch2)  # -> Text, Plane, Height, Justification
detext_5 = DeconstructText(TextObject=bang.Branch3)  # -> Text, Plane, Height, Justification
detext_6 = DeconstructText(TextObject=bang.Branch4)  # -> Text, Plane, Height, Justification
detext_7 = DeconstructText(TextObject=bang.Branch5)  # -> Text, Plane, Height, Justification
detext_8 = DeconstructText(TextObject=bang.Branch6)  # -> Text, Plane, Height, Justification
detext_9 = DeconstructText(TextObject=bang.Branch7)  # -> Text, Plane, Height, Justification
detext_10 = DeconstructText(TextObject=bang.Branch8)  # -> Text, Plane, Height, Justification
detext_11 = DeconstructText(TextObject=bang.Branch9)  # -> Text, Plane, Height, Justification
detext_12 = DeconstructText(TextObject=bang.Branch10)  # -> Text, Plane, Height, Justification
detext_13 = DeconstructText(TextObject=bang.Branch11)  # -> Text, Plane, Height, Justification
detext_14 = DeconstructText(TextObject=bang.Branch12)  # -> Text, Plane, Height, Justification
detext_15 = DeconstructText(TextObject=bang.Branch13)  # -> Text, Plane, Height, Justification
detext_16 = DeconstructText(TextObject=bang.Branch14)  # -> Text, Plane, Height, Justification
detext_17 = DeconstructText(TextObject=bang.Branch15)  # -> Text, Plane, Height, Justification
detext_18 = DeconstructText(TextObject=bang.Branch16)  # -> Text, Plane, Height, Justification
detext_19 = DeconstructText(TextObject=bang.Branch17)  # -> Text, Plane, Height, Justification
detext_20 = DeconstructText(TextObject=bang.Branch18)  # -> Text, Plane, Height, Justification
detext_21 = DeconstructText(TextObject=bang.Branch19)  # -> Text, Plane, Height, Justification
pt_2 = Point(detext_3.Plane)
pt_3 = Point(detext_4.Plane)
pt_4 = Point(detext_7.Plane)
pt_5 = Point(detext_9.Plane)
pt_6 = Point(detext_14.Plane)
pt_7 = Point(detext_15.Plane)
pt_8 = Point(detext_16.Plane)
pt_9 = Point(detext_17.Plane)
pt_10 = Point(detext_18.Plane)
pt_11 = Point(detext_2.Plane)
pt_12 = Point(detext_5.Plane)
pt_13 = Point(detext_6.Plane)
pt_14 = Point(detext_8.Plane)
pt_15 = Point(detext_10.Plane)
pt_16 = Point(detext_11.Plane)
pt_17 = Point(detext_12.Plane)
pt_18 = Point(detext_13.Plane)
pt_19 = Point(detext_19.Plane)
pt_20 = Point(detext_20.Plane)
pt_21 = Point(detext_21.Plane)
merge_4 = Merge(
    Data1=pt_11,
    Data2=pt_2,
    Data3=pt_3,
    Data4=pt_12,
    Data5=pt_13,
    Data6=pt_4,
    Data7=pt_14,
    Data8=pt_5,
    Data9=pt_15,
    Data10=pt_16,
    Data11=pt_17,
    Data12=pt_6,
    Data13=pt_7,
    Data14=pt_8,
    Data15=pt_9,
    Data16=pt_10,
    Data17=pt_19,
    Data18=pt_18,
    Data19=pt_20,
    Data20=pt_21)
flatten_2 = FlattenTree(Tree=merge_4, Path="{0}")

# ----
# 求内部曲线转折点
crv_28 = Curve()  # disabled
number_slider_12 = Slider(300, range=0..1000)  # disabled
neg = Negative(Value=number_slider_12)  # disabled
filter_8 = StreamFilter(Gate=toggle, Stream0=number_slider_12, Stream1=neg)  # disabled
number_slider_13 = Slider(60, range=0..100)  # disabled

ext = ExtendCurve(Curve=crv_28, Type=0, Start=number_slider, End=number_slider)  # disabled

# ----
# 第二层
# 
# Curves(location point)+ Smooth Curves(architecture line)
# 第二层-区分阴阳角
area_2 = Area(Geometry=geo_2)  # -> Area, Centroid; disabled
crv_29 = Curve(crv_28)  # disabled
pull_2 = PullPoint(Point=area_2.Centroid, Geometry=crv_29, ClosestOnly=True)  # -> ClosestPoint, Distance; disabled
number_slider_14 = Slider(200, range=0..1000)  # disabled
number_slider_15 = Slider(100, range=0..300)  # disabled

# ----
# 第二层-阴阳角
panel_27 = Panel("0.5 * Pi")  # disabled
toggle_2 = BooleanToggle(True)  # disabled
neg_2 = Negative(Value=panel_27)  # disabled
filter_9 = StreamFilter(Gate=toggle_2, Stream0=panel_27, Stream1=neg_2)  # disabled

# ----
# 第二层-大面定位
panel_28 = Panel("0.5 * Pi")  # disabled
toggle_3 = BooleanToggle(True)  # disabled
neg_3 = Negative(Value=panel_28)  # disabled
filter_10 = StreamFilter(Gate=toggle_3, Stream0=panel_28, Stream1=neg_3)  # disabled

number_slider_16 = Slider(300, range=0..1000)  # disabled
number_slider_17 = Slider(1.5, range=0..10)  # disabled

number_slider_18 = Slider(300, range=0..1000)  # disabled
number_slider_19 = Slider(1.5, range=0..10)  # disabled

number_slider_20 = Slider(300, range=0..1000)  # disabled
number_slider_21 = Slider(1.5, range=0..10)  # disabled

# ----
# 显示"False"时要选择线段延长
list_11 = ValueList({"线段不延长": 0, "线段延长": 1}, selected="线段延长")  # disabled

filter_11 = StreamFilter(Gate=list_11, Stream0=crv_28, Stream1=ext)  # disabled

disc_2 = Discontinuity(Curve=graft(filter_11), Level=1)  # -> Points, Parameters; disabled
crv_cp = CurveClosestPoint(Point=disc_2.Points, Curve=graft(filter_11))  # -> Point, Parameter, Distance; disabled
eval = EvaluateCurve(Curve=graft(filter_11), Parameter=crv_cp.Parameter)  # -> flatten(Point), Tangent, flatten(Angle); disabled
deg = Degrees(Radians=eval.Angle)  # disabled
offset_8 = OffsetCurve(Curve=filter_11, Distance=expr("-X", filter_8), Corners=1)  # disabled
panel_29 = Panel(deg)  # disabled
larger_2 = LargerThan(FirstNumber=deg, SecondNumber=number_slider_13)  # -> LargerThan, OrEqualTo; disabled
disc_3 = Discontinuity(Curve=offset_8, Level=1)  # -> flatten(Points), Parameters; disabled
dispatch_6 = Dispatch(List=eval.Point, DispatchPattern=larger_2.LargerThan)  # -> ListA, ListB; disabled
end = EndPoints(Curve=filter_11)  # -> Start, End; disabled
data_7 = Data(dispatch_6.ListA)  # disabled
pull_3 = PullPoint(Point=data_7, Geometry=flatten(offset_8), ClosestOnly=True)  # -> ClosestPoint, Distance; disabled
testpoint = TestPoint(archPoint=pull_3.ClosestPoint, crvPoint=disc_3.Points)  # -> out, specialPt; inputs archPoint: list of Point3d, crvPoint: list of Point3d; disabled
# ---------- testpoint: C# ----------
    List<int> passIndex = new List<int>();

    for(int i = 0; i < archPoint.Count; i++){
      foreach(Point3d t in crvPoint){
        if(archPoint[i].X == t.X && archPoint[i].Y == t.Y && archPoint[i].Z == t.Z){
          Print("pass");
          passIndex.Add(i);}
      }
    }

    specialPt = passIndex;
# ---------- end testpoint ----------

# ----
# 阴角
item_4 = ListItem(List=data_7, Index=testpoint.specialPt, Wrap=True)  # disabled

# ----
# SmoothCurve-阴角&阳角
# 阳角
cull_i = CullIndex(List=data_7, Indices=testpoint.specialPt, Wrap=True)  # disabled

dist = Distance(PointA=pull_2.ClosestPoint, PointB=data_7)  # disabled
sort_2 = SortList(Keys=dist)  # -> Keys, ValuesA; disabled
panel_30 = Panel(sort_2.Keys)  # disabled
smaller = SmallerThan(FirstNumber=dist, SecondNumber=number_slider_14)  # -> SmallerThan, OrEqualTo; disabled
dispatch_7 = Dispatch(List=geo_2, DispatchPattern=smaller.SmallerThan)  # -> ListA, ListB; disabled
crv_30 = Curve(filter_11)  # disabled

data_8 = Data(dispatch_7.ListA)  # disabled
explode_2 = Explode(Curve=data_8, Recursive=True)  # -> Segments, Vertices; disabled
len_2 = Length(Curve=explode_2.Segments)  # disabled
sort_3 = SortList(Keys=reverse(len_2), ValuesA=explode_2.Segments)  # -> Keys, ValuesA; disabled
item_5 = ListItem(List=sort_3.ValuesA, Index=0, Wrap=True)  # -> flatten(Item); disabled
area_3 = Area(Geometry=data_8)  # -> Area, Centroid; disabled
midpt_3 = CurveMiddle(Curve=item_5)  # disabled
move2pt = MoveToPoint(Geometry=item_5, PointA=midpt_3, PointB=area_3.Centroid)  # -> Moved, Vector, Transform; disabled
end_2 = EndPoints(Curve=move2pt.Moved)  # -> Start, End; disabled
ln_2 = Line(StartPoint=end_2.Start, EndPoint=end_2.End)  # disabled
xy_17 = XYPlane(Origin=end_2.End)  # disabled
rotate = Rotate(Geometry=ln_2, Angle=filter_9, Plane=xy_17)  # -> Geometry, Transform; disabled
pl = ConstructPlane(Origin=end_2.End, XAxis=rotate.Geometry, YAxis=ln_2)  # disabled

data_9 = Data(dispatch_7.ListB)  # disabled
explode_3 = Explode(Curve=data_9, Recursive=True)  # -> Segments, Vertices; disabled
len_3 = Length(Curve=explode_3.Segments)  # disabled
sort_4 = SortList(Keys=reverse(len_3), ValuesA=explode_3.Segments)  # -> Keys, ValuesA; disabled
item_6 = ListItem(List=sort_4.ValuesA, Index=0, Wrap=True)  # -> flatten(Item); disabled
area_4 = Area(Geometry=data_9)  # -> Area, Centroid; disabled
midpt_4 = CurveMiddle(Curve=item_6)  # disabled
move2pt_2 = MoveToPoint(Geometry=item_6, PointA=midpt_4, PointB=area_4.Centroid)  # -> Moved, Vector, Transform; disabled
end_3 = EndPoints(Curve=move2pt_2.Moved)  # -> Start, End; disabled
ln_3 = Line(StartPoint=end_3.Start, EndPoint=end_3.End)  # disabled
xy_18 = XYPlane(Origin=end_3.End)  # disabled
rotate_2 = Rotate(Geometry=ln_3, Angle=filter_10, Plane=xy_18)  # -> Geometry, Transform; disabled
pl_2 = ConstructPlane(Origin=end_3.End, XAxis=rotate_2.Geometry, YAxis=ln_3)  # disabled

data_10 = Data(flatten(pl_2))  # disabled
deplane = DeconstructPlane(Plane=data_10)  # -> Origin, XAxis, YAxis, ZAxis; disabled
amp = Amplitude(Vector=deplane.YAxis, Amplitude=number_slider_18)  # disabled
move = Move(Geometry=deplane.Origin, Motion=amp)  # -> Geometry, Transform; disabled
ln_4 = Line(StartPoint=deplane.Origin, EndPoint=move.Geometry)  # disabled
midpt_5 = CurveMiddle(Curve=ln_4)  # disabled
scale = Scale(Geometry=ln_4, Center=midpt_5, Factor=number_slider_19)  # -> Geometry, Transform; disabled
ccx_2 = CurveCurve(CurveA=scale.Geometry, CurveB=crv_30)  # -> Points, ParamsA, ParamsB; disabled

dist_2 = Distance(PointA=graft(end_2.End), PointB=cull_i)  # disabled
sort_5 = SortList(Keys=dist_2)  # -> Keys, ValuesA; disabled
item_7 = ListItem(List=sort_5.Keys, Index=0, Wrap=True)  # disabled
smaller_2 = SmallerThan(FirstNumber=item_7, SecondNumber=number_slider_15)  # -> SmallerThan, OrEqualTo; disabled
flatten_3 = FlattenTree(Tree=item_7, Path="{0}")  # disabled
dispatch_8 = Dispatch(List=graft(pl), DispatchPattern=smaller_2.SmallerThan)  # -> ListA, ListB; disabled
panel_31 = Panel(flatten_3)  # disabled
flatten_4 = FlattenTree(Tree=ccx_2.Points, Path="{0}")  # disabled
lng_3 = ListLength(List=scale.Geometry)  # disabled
lng_4 = ListLength(List=flatten_4)  # disabled

data_11 = Data(flatten(dispatch_8.ListA))  # disabled
deplane_2 = DeconstructPlane(Plane=data_11)  # -> Origin, XAxis, YAxis, ZAxis; disabled
amp_2 = Amplitude(Vector=deplane_2.YAxis, Amplitude=number_slider_16)  # disabled
move_2 = Move(Geometry=deplane_2.Origin, Motion=amp_2)  # -> Geometry, Transform; disabled
ln_5 = Line(StartPoint=deplane_2.Origin, EndPoint=move_2.Geometry)  # disabled
midpt_6 = CurveMiddle(Curve=ln_5)  # disabled
scale_2 = Scale(Geometry=ln_5, Center=midpt_6, Factor=number_slider_17)  # -> Geometry, Transform; disabled
ccx_3 = CurveCurve(CurveA=scale_2.Geometry, CurveB=crv_30)  # -> Points, ParamsA, ParamsB; disabled

data_12 = Data(flatten(dispatch_8.ListB))  # disabled
deplane_3 = DeconstructPlane(Plane=data_12)  # -> Origin, XAxis, YAxis, ZAxis; disabled
amp_3 = Amplitude(Vector=deplane_3.YAxis, Amplitude=number_slider_20)  # disabled
move_3 = Move(Geometry=deplane_3.Origin, Motion=amp_3)  # -> Geometry, Transform; disabled
ln_6 = Line(StartPoint=deplane_3.Origin, EndPoint=move_3.Geometry)  # disabled
midpt_7 = CurveMiddle(Curve=ln_6)  # disabled
scale_3 = Scale(Geometry=ln_6, Center=midpt_7, Factor=number_slider_21)  # -> Geometry, Transform; disabled
ccx_4 = CurveCurve(CurveA=scale_3.Geometry, CurveB=crv_30)  # -> Points, ParamsA, ParamsB; disabled

equals_2 = Equality(FirstNumber=lng_3, SecondNumber=lng_4)  # -> Equality, Inequality; disabled
panel_32 = Panel(equals_2.Equality)  # disabled

# ----
# InsideCurve-大面
move2pt_3 = MoveToPoint(Geometry=data_10, PointA=flatten(deplane.Origin), PointB=flatten(ccx_2.Points))  # -> Moved, Vector, Transform; disabled

# ----
# InsideCurve-阳角
move2pt_4 = MoveToPoint(Geometry=data_11, PointA=deplane_2.Origin, PointB=ccx_3.Points)  # -> Moved, Vector, Transform; disabled

# ----
# InsideCurve-阴角
move2pt_5 = MoveToPoint(Geometry=data_12, PointA=deplane_3.Origin, PointB=ccx_4.Points)  # -> Moved, Vector, Transform; disabled

# ----
# 测试Smooth Curve是否与每个Block相切
# blocks + smooth curves
# remove duplicate blocks
# blocks + special curves
deblock_2 = DeconstructBlock(Block=project_9.Geometry)  # -> Name, Plane, Geometry
pln_2 = Plane(flatten(deblock_2.Plane))
deplane_4 = DeconstructPlane(Plane=pln_2)  # -> Origin, XAxis, YAxis, ZAxis
cullduppoints_2 = RemoveDuplicatePoints(InputPoints=deplane_4.Origin, Tolerance=0.001)  # -> OutputPoints, FirstPointIndexes
null_3 = NullItem(Item=cullduppoints_2.FirstPointIndexes)  # -> NullFlags, InvalidFlags, Description
dispatch_9 = Dispatch(List=pln_2, DispatchPattern=null_3.InvalidFlags)  # -> ListA, ListB
dispatch_10 = Dispatch(List=flatten(project_9.Geometry), DispatchPattern=null_3.InvalidFlags)  # -> ListA, ListB
pln_3 = Plane(dispatch_9.ListA)
data_13 = Data(flatten(pln_3))
deplane_5 = DeconstructPlane(Plane=data_13)  # -> Origin, XAxis, YAxis, ZAxis
pln_4 = Plane(data_13)
amp_4 = Amplitude(Vector=deplane_5.YAxis, Amplitude=Slider(300, range=0..1000))
move_4 = Move(Geometry=deplane_5.Origin, Motion=amp_4)  # -> Geometry, Transform
ln_7 = Line(StartPoint=deplane_5.Origin, EndPoint=move_4.Geometry)
crv_31 = Curve(crv_10)
midpt_8 = CurveMiddle(Curve=ln_7)
scale_4 = Scale(Geometry=ln_7, Center=midpt_8, Factor=Slider(7.8, range=0..10))  # -> Geometry, Transform
merge_5 = Merge(Data1=scale_4.Geometry, Data2=crv_31)
mcx = MultipleCurves(Curves=flatten(merge_5))  # -> Points, IndexA, IndexB, ParamA, ParamB
cull_i_2 = CullIndex(List=flatten(pln_4), Indices=mcx.IndexA, Wrap=True)
item_8 = ListItem(List=pln_4, Index=mcx.IndexA, Wrap=True)
pln_5 = Plane(cull_i_2)
pln_6 = Plane(item_8)

deblock_3 = DeconstructBlock(Block=dispatch_10.ListA)  # -> Name, Plane, Geometry
data_14 = Data(dispatch_10.ListA)

cull_i_3 = CullIndex(List=flatten(data_14), Indices=mcx.IndexA, Wrap=True)
item_9 = ListItem(List=flatten(data_14), Index=mcx.IndexA, Wrap=True)
data_15 = Data(cull_i_3)
data_16 = Data(item_9)

# ----
# 第一层
# 
# Special Curves(architecture line)
crv_32 = Curve(crv_11)
pln_7 = Plane(pln_5)
deplane_6 = DeconstructPlane(Plane=pln_7)  # -> Origin, XAxis, YAxis, ZAxis
disc_4 = Discontinuity(Curve=crv_32, Level=1)  # -> Points, Parameters
pull_4 = PullPoint(Point=deplane_6.Origin, Geometry=disc_4.Points, ClosestOnly=True)  # -> ClosestPoint, Distance
sort_6 = SortList(Keys=pull_4.Distance)  # -> reverse(Keys), ValuesA
panel_33 = Panel(sort_6.Keys)
larger_3 = LargerThan(FirstNumber=pull_4.Distance, SecondNumber=Slider(300, range=0..1000))  # -> LargerThan, OrEqualTo
dispatch_11 = Dispatch(List=pln_7, DispatchPattern=larger_3.LargerThan)  # -> ListA, ListB
data_17 = Data(dispatch_11.ListB)
deplane_7 = DeconstructPlane(Plane=data_17)  # -> Origin, XAxis, YAxis, ZAxis
pull_5 = PullPoint(Point=deplane_7.Origin, Geometry=disc_4.Points, ClosestOnly=True)  # -> ClosestPoint, Distance
pl_3 = ConstructPlane(Origin=pull_5.ClosestPoint, XAxis=deplane_7.XAxis, YAxis=deplane_7.YAxis)

# ----
# 测试Smooth Curve是否与每个Block相切
# blocks + smooth curves
# remove duplicate blocks
# blocks + special curves
deblock_4 = DeconstructBlock(Block=project_8.Geometry)  # -> Name, Plane, Geometry
pln_8 = Plane(flatten(deblock_4.Plane))
deplane_8 = DeconstructPlane(Plane=pln_8)  # -> Origin, XAxis, YAxis, ZAxis
cullduppoints_3 = RemoveDuplicatePoints(InputPoints=deplane_8.Origin, Tolerance=0.001)  # -> OutputPoints, FirstPointIndexes
null_4 = NullItem(Item=cullduppoints_3.FirstPointIndexes)  # -> NullFlags, InvalidFlags, Description
dispatch_12 = Dispatch(List=pln_8, DispatchPattern=null_4.InvalidFlags)  # -> ListA, ListB
dispatch_13 = Dispatch(List=flatten(project_8.Geometry), DispatchPattern=null_4.InvalidFlags)  # -> ListA, ListB
pln_9 = Plane(dispatch_12.ListA)
data_18 = Data(flatten(pln_9))
deplane_9 = DeconstructPlane(Plane=data_18)  # -> Origin, XAxis, YAxis, ZAxis
pln_10 = Plane(data_18)
amp_5 = Amplitude(Vector=deplane_9.YAxis, Amplitude=Slider(300, range=0..1000))
move_5 = Move(Geometry=deplane_9.Origin, Motion=amp_5)  # -> Geometry, Transform
ln_8 = Line(StartPoint=deplane_9.Origin, EndPoint=move_5.Geometry)
crv_33 = Curve(crv_10)
midpt_9 = CurveMiddle(Curve=ln_8)
scale_5 = Scale(Geometry=ln_8, Center=midpt_9, Factor=Slider(7.8, range=0..10))  # -> Geometry, Transform
merge_6 = Merge(Data1=scale_5.Geometry, Data2=crv_33)
mcx_2 = MultipleCurves(Curves=flatten(merge_6))  # -> Points, IndexA, IndexB, ParamA, ParamB
cull_i_4 = CullIndex(List=flatten(pln_10), Indices=mcx_2.IndexA, Wrap=True)
item_10 = ListItem(List=pln_10, Index=mcx_2.IndexA, Wrap=True)
pln_11 = Plane(cull_i_4)
pln_12 = Plane(item_10)

deblock_5 = DeconstructBlock(Block=dispatch_13.ListA)  # -> Name, Plane, Geometry
data_19 = Data(dispatch_13.ListA)

cull_i_5 = CullIndex(List=flatten(data_19), Indices=mcx_2.IndexA, Wrap=True)
item_11 = ListItem(List=flatten(data_19), Index=mcx_2.IndexA, Wrap=True)
data_20 = Data(cull_i_5)
data_21 = Data(item_11)

# ----
# 板埋Modeling
multiplication = Multiplication(A=s_x, B=addition)
multiplication_2 = Multiplication(A=s_y, B=addition_2)
recgrid = Rectangular(Plane=PlaneXY(0, 0, 0), SizeX=s_x, SizeY=s_y, ExtentX=addition, ExtentY=addition_2)  # -> Cells, Points
直径 = Text(filter_3)
division_2 = Division(A=multiplication, B=2)
division_3 = Division(A=multiplication_2, B=2)
vec = VectorXYZ(XComponent=expr("-x", division_2), YComponent=expr("-x", division_3), ZComponent=0)  # -> Vector, Length
move_6 = Move(Geometry=recgrid.Points, Motion=vec.Vector)  # -> Geometry, Transform
division_4 = Division(A=直径, B=2)
cyl = Cylinder(Base=move_6.Geometry, Radius=division_4, Length=expr("-x", expression))
X = UnitX(Factor=直径)
multiplication_3 = Multiplication(A=直径, B=6)
edges = BrepEdges(Brep=cyl)  # -> Naked, Interior, NonManifold
item_12 = ListItem(List=edges.Naked, Index=0, Wrap=True)
max_2 = Maximum(A=multiplication_3, B=70)
move_7 = Move(Geometry=item_12, Motion=X)  # -> Geometry, Transform
multiplication_4 = Multiplication(A=max_2, B=2)
addition_3 = Addition(A=multiplication, B=multiplication_4)
addition_4 = Addition(A=multiplication_2, B=multiplication_4)
division_5 = Division(A=t, B=2)
expression_2 = Expression(x=addition_4, Expression="Ceiling(x/10)*10/2")
expression_3 = Expression(x=addition_3, Expression="Ceiling(x/10)*10/2")
round = Round(Number=division_5)  # -> Nearest, Floor, Ceiling
multiplication_5 = Multiplication(A=round.Ceiling, B=2)
dom = ConstructDomain(DomainStart=expr("-x", expression_2), DomainEnd=expression_2)
dom_2 = ConstructDomain(DomainStart=expr("-x", expression_3), DomainEnd=expression_3)
box = DomainBox(Base=PlaneXY(0, 0, 0), X=dom_2, Y=dom, Z=multiplication_5)
Z = UnitZ(Factor=expr("-x", multiplication_5))
move_8 = Move(Geometry=box, Motion=Z)  # -> Geometry, Transform
Z_2 = UnitZ(Factor=expr("-x", multiplication_5))

multiplication_6 = Multiplication(A=直径, B=5)

Z_3 = UnitZ(Factor=multiplication_6)
extr = Extrude(Base=move_7.Geometry, Direction=Z_3)
cap = CapHoles(Brep=[extr, cyl])
merge_7 = Merge(Data1=cap, Data2=box)
flatten_5 = FlattenTree(Tree=merge_7, Path="{0}")
move_9 = Move(Geometry=flatten_5, Motion=Z_2)  # -> Geometry, Transform

box_2 = DomainBox(Base=PlaneXY(0, 0, 0), X=dom_2, Y=dom_2, Z=multiplication_5)
merge_8 = Merge(Data1=cap, Data2=box_2)
flatten_6 = FlattenTree(Tree=merge_8, Path="{0}")
move_10 = Move(Geometry=flatten_6, Motion=Z_2)  # -> Geometry, Transform
entwine = Entwine(Branch00=move_9.Geometry, Branch01=move_10.Geometry, FlattenInputs=True)

# ---- group: 选单体
板埋or槽埋or板槽埋 = StreamFilter(Gate=list, Stream0=entwine, Stream1=1.1)

# ----
# 三视图
# hidden lines of top+pers view
# move to center
# 如果无法完整的生成埋件的三视图，
# 建议选择埋件的3D在Rhino中将
# Top/Perspective/Front/Right 试图缩放至合适大小后重新运行
panel_34 = Panel("""Top
Perspective
Front
Right""")
m2d_rhino = Make2DRhinoView(Name=panel_34, Clip=True)
make2d = Make2D(Geometry=板埋or槽埋or板槽埋, View=m2d_rhino, TangentEdges=False, TangentSeams=False, AutoComputeMake2D=False)  # -> VisibleCurves, VisibleIndex, VisibleType, HiddenCurves, HiddenIndex, HiddenType
bang_2 = ExplodeTree(Data=make2d.VisibleCurves)  # -> Branch0, Branch1, Branch2, Branch3, Branch4, Branch5, Branch6, Branch7
bang_3 = ExplodeTree(Data=make2d.VisibleCurves)  # -> Branch0, Branch1, Branch2, Branch3, Branch4, Branch5, Branch6, Branch7
divdist = DivideDistance(Curve=make2d.HiddenCurves, Distance=Slider(1, range=0..10))  # -> Points, Tangents, Parameters
graft_2 = GraftTree(Tree=make2d.HiddenCurves, IncludeEmptyLists=True, IncludeNullItems=True)
shatter = Shatter(Curve=graft_2, Parameters=divdist.Parameters)
dispatch_14 = Dispatch(List=shatter, DispatchPattern=[True, False])  # -> ListA, ListB
crv_34 = Curve(dispatch_14.ListA)
pshift = ShiftPaths(Data=crv_34, Offset=-1)
pshift_2 = ShiftPaths(Data=pshift, Offset=-1)
bang_4 = ExplodeTree(Data=pshift_2)  # -> Branch0, Branch1, Branch2, Branch3, Branch4, Branch5, Branch6, Branch7
bang_5 = ExplodeTree(Data=pshift_2)  # -> Branch0, Branch1, Branch2, Branch3, Branch4, Branch5, Branch6, Branch7
entwine_2 = Entwine(Branch00=bang_5.Branch4, Branch01=bang_3.Branch4, FlattenInputs=True)  # -> flatten(Result)
entwine_3 = Entwine(Branch00=bang_5.Branch5, Branch01=bang_3.Branch5, FlattenInputs=True)  # -> flatten(Result)
entwine_4 = Entwine(Branch00=bang_4.Branch0, Branch01=bang_2.Branch0, FlattenInputs=True)  # -> flatten(Result)
entwine_5 = Entwine(Branch00=bang_4.Branch1, Branch01=bang_2.Branch1, FlattenInputs=True)  # -> flatten(Result)
entwine_6 = Entwine(Branch00=entwine_4, Branch01=entwine_5, Branch02=bang_2.Branch2, Branch03=bang_2.Branch3, FlattenInputs=True)
entwine_7 = Entwine(Branch00=entwine_2, Branch01=entwine_3, Branch02=bang_3.Branch6, Branch03=bang_3.Branch7, FlattenInputs=True)
group = Group(Objects=entwine_6)
group_2 = Group(Objects=entwine_7)
entwine_8 = Entwine(Branch00=group, Branch01=group_2, FlattenInputs=True)
pshift_3 = ShiftPaths(Data=entwine_8, Offset=-1)
pshift_4 = ShiftPaths(Data=entwine_8, Offset=-1)
number_slider_22 = Slider(2, range=0..10)
boxprop = BoxProperties(Box=pshift_3)  # -> Center, Diagonal, Area, Volume, Degeneracy
pt_22 = Point(Point(957.9296072, 367.7685097, 0))
pt_23 = Point("0,0,0")
recgrid_2 = Rectangular(
    Plane=pt_22,
    SizeX=Slider(12, range=1..20, expression="X*50"),
    SizeY=Slider(10, range=1..20, expression="X*50"),
    ExtentX=number_slider_22,
    ExtentY=number_slider_22)  # -> Cells, Points
vec2pt = Vector2Pt(PointA=boxprop.Center, PointB=pt_23, Unitize=False)  # -> Vector, Length
flatten_7 = FlattenTree(Tree=recgrid_2.Points, Path="{0}")
move_11 = Move(Geometry=pshift_4, Motion=vec2pt.Vector)  # -> flatten(Geometry), Transform
orient = Orient(Geometry=flatten(move_11.Geometry), Source=PlaneXY(0, 0, 0), Target=flatten_7)  # -> Geometry, Transform
cull_i_6 = CullIndex(List=orient.Geometry, Indices="-1", Wrap=True)
split = SplitList(List=cull_i_6, Index="4")  # -> ListA, ListB
data_22 = Data(split.ListA)
data_23 = Data(split.ListB)
entwine_9 = Entwine(Branch00=data_22, Branch01=data_23, FlattenInputs=True)
geo_4 = Geometry(entwine_9)

# ---- group: 单体定Top/Side
item_13 = ListItem(List=geo_4, Index=2, Wrap=True)
item_14 = ListItem(List=geo_4, Index=Slider(0, range=0..10), Wrap=True)
cluster = Cluster(G=item_14)
cluster_2 = Cluster(G=item_13)

# ---- group: 单体定Top/Side / Top/Side
filter_12 = StreamFilter(Gate=list_2, Stream0=cluster, Stream1=cluster_2)

# ---- group: 单体定Top/Side / Monomer + Top/Side
filter_13 = StreamFilter(Gate=list, Stream0=filter_12, Stream1=filter_12, Stream2=filter_12)  # -> flatten(Stream)

# ---- group: Block
# 自定义块所在图层
# 自定义块所在图层颜色
# 自定义块名称
panel_35 = Panel("Embeded::Embeded")
layer_2 = DefineLayer(Name=panel_35, Color=ColourSwatch(SwatchColor=RGB(255, 0, 0)))
attributes = DefineObjectAttributes(Layer=layer_2)
block = DefineBlock(Geometry=filter_12, Attributes=attributes, BlockName="Steel Plate", BasePlane=PlaneXY(0, 0, 0))

# ----
# 阳角埋件布置
pt_24 = Point()
explode_4 = Explode(Curve=crv_16, Recursive=True)  # -> Segments, Vertices
cp = ClosestPoint(Point=pt_24, Cloud=explode_4.Vertices)  # -> ClosestPoint, CPIndex, Distance
cir = Circle(Plane=cp.ClosestPoint, Radius=Slider(150, range=0..1000))
pt_25 = Point(cp.ClosestPoint)
ccx_5 = CurveCurve(CurveA=cir)  # -> Points, ParamsA, ParamsB
item_15 = ListItem(List=ccx_5.Points, Index=0, Wrap=True)  # -> Item, Item1
ln_9 = Line(StartPoint=graft(pt_25), EndPoint=graft(item_15.Item))  # -> flatten(Line)
ln_10 = Line(StartPoint=graft(pt_25), EndPoint=graft(item_15.Item1))  # -> flatten(Line)
item_16 = ListItem(List=filter_13, Index="1", Wrap=True)
pl_4 = ConstructPlane(Origin=pt_25, XAxis=ln_9, YAxis=ln_10)
bbox = BoundingBox(Content=graft(item_16), Plane=PlaneXY(0, 0, 0))  # -> Box, Box_2
srf = Surface(bbox.Box)
explode_5 = Explode(Curve=srf, Recursive=True)  # -> Segments, Vertices
item_17 = ListItem(List=explode_5.Vertices, Index=0, Wrap=True)  # -> Item, Item1, Item2
ln_11 = Line(StartPoint=graft(item_17.Item1), EndPoint=graft(item_17.Item2))
ln_12 = Line(StartPoint=graft(item_17.Item1), EndPoint=graft(item_17.Item))
ln_13 = Line(StartPoint=graft(item_17.Item1), EndPoint=graft(item_17.Item))
ln_14 = Line(StartPoint=graft(item_17.Item1), EndPoint=graft(item_17.Item2))
pl_5 = ConstructPlane(Origin=item_17.Item1, XAxis=ln_14, YAxis=ln_13)
pl_6 = ConstructPlane(Origin=item_17.Item1, XAxis=ln_12, YAxis=ln_11)
orient_2 = Orient(Geometry=item_16, Source=pl_6, Target=pl_4)  # -> Geometry, Transform
orient_3 = Orient(Geometry=item_16, Source=pl_5, Target=pl_4)  # -> Geometry, Transform
merge_9 = Merge(Data1=orient_2.Geometry, Data2=orient_3.Geometry)
filter_14 = StreamFilter(Gate=list_2, Stream0=orient_2.Geometry, Stream1=merge_9)
bbox_2 = BoundingBox(Content=filter_14, Plane=PlaneXY(0, 0, 0))  # -> Box, Box_2
entwine_10 = Entwine(Branch00=filter_14, Branch01=bbox_2.Box, FlattenInputs=True)
flip = FlipMatrix(Data=entwine_10)
item_18 = ListItem(List=flip, Index=-1, Wrap=True)  # -> flatten(Item)
item_19 = ListItem(List=flip, Index="0", Wrap=True)  # -> flatten(Item)

# ---- group: 大面
# 大面埋件布置
number_slider_23 = Slider(0.002, range=0..0.01)
filter_15 = StreamFilter(Gate=list_2, Stream0=expression_2, Stream1=number_slider_23)
filter_16 = StreamFilter(Gate=list, Stream0=filter_15, Stream1=expression_2, Stream2=filter_15)
offset_9 = OffsetCurve(Distance=expr("-x", filter_16), Plane=PlaneXY(0, 0, 0), Corners=1)
crv_cp_2 = CurveClosestPoint(Curve=offset_9)  # -> Point, Parameter, Distance
crv_cp_3 = CurveClosestPoint()  # -> Point, Parameter, Distance
vec2pt_2 = Vector2Pt(PointA=crv_cp_2.Point, PointB=crv_cp_3.Point, Unitize=False)  # -> expr("-x", Vector), Length
eval_2 = EvaluateCurve(Parameter=crv_cp_3.Parameter)  # -> Point, Tangent, Angle
pl_7 = ConstructPlane(Origin=crv_cp_3.Point, XAxis=eval_2.Tangent, YAxis=vec2pt_2.Vector)
orient_4 = Orient(Geometry=block, Source=PlaneXY(0, 0, 0), Target=pl_7)  # -> flatten(Geometry), Transform

# ---- group: 阴角
# 阴角埋件布置
# Rhino 文件中导入的块名
explode_6 = Explode(Curve=crv_16, Recursive=True)  # -> Segments, Vertices
cp_2 = ClosestPoint(Cloud=explode_6.Vertices)  # -> ClosestPoint, CPIndex, Distance
pshift_5 = ShiftPaths(Offset=-1)
crv_cp_4 = CurveClosestPoint(Point=pshift_5, Curve=offset_9)  # -> Point, Parameter, Distance
crv_cp_5 = CurveClosestPoint(Point=pshift_5)  # -> Point, Parameter, Distance
vec2pt_3 = Vector2Pt(PointA=crv_cp_4.Point, PointB=crv_cp_5.Point, Unitize=False)  # -> expr("-x", Vector), Length
eval_3 = EvaluateCurve(Parameter=crv_cp_5.Parameter)  # -> Point, Tangent, Angle
pl_8 = ConstructPlane(Origin=crv_cp_5.Point, XAxis=eval_3.Tangent, YAxis=vec2pt_3.Vector)
orient_5 = Orient(Geometry=block, Source=PlaneXY(0, 0, 0), Target=pl_8)  # -> Geometry, Transform

# ---- group: Datea / 2
lng_5 = ListLength(List=orient_4.Geometry)
division_6 = Division(A=lng_5, B=2)
split_2 = SplitList(List=orient_4.Geometry, Index=division_6)  # -> ListA, ListB
data_24 = Data(split_2.ListA)

# ----
bbox_3 = BoundingBox(Content=data_24, Plane=PlaneXY(0, 0, 0))  # -> Box, Box_2
entwine_11 = Entwine(Branch00=data_24, Branch01=bbox_3.Box, FlattenInputs=True)
flip_2 = FlipMatrix(Data=entwine_11)
item_20 = ListItem(List=flip_2, Index=-1, Wrap=True)  # -> flatten(Item)
item_21 = ListItem(List=flip_2, Index="0", Wrap=True)  # -> flatten(Item)
阴角 = Geometry(orient_5.Geometry)

# ----
# remove duplicate curves
geo_5 = Geometry(project_10.Geometry)
# 第一层
# 
# Curves(location point)+ Smooth Curves(architecture line)
boundary_2 = BoundarySurfaces(Edges=geo_5)
area_5 = Area(Geometry=boundary_2)  # -> Area, Centroid
cullduppoints_4 = RemoveDuplicatePoints(InputPoints=area_5.Centroid, Tolerance=Slider(0.1, range=0..0.1))  # -> OutputPoints, FirstPointIndexes
null_5 = NullItem(Item=cullduppoints_4.FirstPointIndexes)  # -> NullFlags, InvalidFlags, Description
dispatch_15 = Dispatch(List=boundary_2, DispatchPattern=null_5.NullFlags)  # -> ListA, ListB
geo_6 = Geometry(dispatch_15.ListA)
crv_35 = Curve(crv_10)
area_6 = Area(Geometry=geo_6)  # -> Area, Centroid
pull_6 = PullPoint(Point=area_6.Centroid, Geometry=crv_35, ClosestOnly=True)  # -> ClosestPoint, Distance
neg_4 = Negative(Value="0.5 * Pi")
neg_5 = Negative(Value="1.5 * Pi")
filter_17 = StreamFilter(Gate=Toggle(True), Stream0="0.5 * Pi", Stream1=neg_4)
filter_18 = StreamFilter(Gate=Toggle(True), Stream0="1.5 * Pi", Stream1=neg_5)
crv_36 = Curve(crv_10)

# ----
# 第一层
# 
# Angular Curves(architecture line)
number_slider_24 = Slider(84, range=0..1000)
crv_37 = Curve(crv_14)
disc_5 = Discontinuity(Curve=crv_37, Level=1)  # -> Points, Parameters
end_4 = EndPoints(Curve=crv_37)  # -> Start, End
flatten_8 = FlattenTree(Tree=disc_5.Points, Path="{0}")

# ----
# 第一层
# 
# Angular Curves(architecture line)
crv_38 = Curve(crv_12)
disc_6 = Discontinuity(Curve=crv_38, Level=1)  # -> Points, Parameters
end_5 = EndPoints(Curve=crv_38)  # -> Start, End
flatten_9 = FlattenTree(Tree=disc_6.Points, Path="{0}")

clscrv = CloseCurve(Curve=crv_13, CloseType=0, Bulge=0.5, Tolerance=0)  # -> Closed, R
crv_39 = Curve(crv_10)
disc_7 = Discontinuity(Curve=graft(crv_39), Level=1)  # -> Points, Parameters
crv_cp_6 = CurveClosestPoint(Point=disc_7.Points, Curve=graft(crv_39))  # -> Point, Parameter, Distance
eval_4 = EvaluateCurve(Curve=graft(crv_39), Parameter=crv_cp_6.Parameter)  # -> flatten(Point), Tangent, flatten(Angle)
deg_2 = Degrees(Radians=eval_4.Angle)
offset_10 = OffsetCurve(Curve=clscrv.Closed, Distance=expr("-X", Slider(300, range=0..1000)), Corners=1)
panel_36 = Panel(deg_2)
larger_4 = LargerThan(FirstNumber=deg_2, SecondNumber=Slider(60, range=0..100))  # -> LargerThan, OrEqualTo
disc_8 = Discontinuity(Curve=offset_10, Level=1)  # -> flatten(Points), Parameters
dispatch_16 = Dispatch(List=eval_4.Point, DispatchPattern=larger_4.LargerThan)  # -> ListA, ListB
data_25 = Data(dispatch_16.ListA)
pull_7 = PullPoint(Point=data_25, Geometry=flatten(offset_10), ClosestOnly=True)  # -> ClosestPoint, Distance
pull_8 = PullPoint(Point=flatten(pln_6), Geometry=crv_39, ClosestOnly=True)  # -> ClosestPoint, Distance
testpoint_2 = TestPoint(archPoint=pull_7.ClosestPoint, crvPoint=disc_8.Points)  # -> out, specialPt; inputs archPoint: list of Point3d, crvPoint: list of Point3d; same code as testpoint
pull_9 = PullPoint(Point=pull_8.ClosestPoint, Geometry=data_25, ClosestOnly=True)  # -> ClosestPoint, Distance
flatten_10 = FlattenTree(Tree=data_16, Path="{0}")
sort_7 = SortList(Keys=pull_9.Distance, ValuesA=flatten_10)  # -> Keys, ValuesA
panel_37 = Panel(sort_7.Keys)
smaller_3 = SmallerThan(FirstNumber=sort_7.Keys, SecondNumber=Slider(100, range=0..100))  # -> SmallerThan, OrEqualTo
dispatch_17 = Dispatch(List=sort_7.ValuesA, DispatchPattern=smaller_3.SmallerThan)  # -> ListA, ListB
data_26 = Data(dispatch_17.ListA)
deblock_6 = DeconstructBlock(Block=data_26)  # -> Name, Plane, Geometry
# 第二层-大面定位
deplane_10 = DeconstructPlane(Plane=deblock_6.Plane)  # -> Origin, XAxis, YAxis, ZAxis
pt_26 = Point(data_25)
pull_10 = PullPoint(Point=deplane_10.Origin, Geometry=pt_26, ClosestOnly=True)  # -> ClosestPoint, Distance
cir_2 = Circle(Plane=pull_10.ClosestPoint, Radius=Slider(300, range=0..1000))
crv_40 = Curve(crv_39)
amp_6 = Amplitude(Vector=deplane_10.YAxis, Amplitude=Slider(200, range=0..1000))
ccx_6 = CurveCurve(CurveA=cir_2, CurveB=crv_40)  # -> Points, ParamsA, ParamsB
move_12 = Move(Geometry=pull_10.ClosestPoint, Motion=amp_6)  # -> Geometry, Transform
item_22 = ListItem(List=ccx_6.Points, Index=0, Wrap=True)
clean = CleanTree(RemoveNulls=True, RemoveInvalid=True, RemoveEmpty=Toggle(True), Tree=item_22)
ln_15 = Line(StartPoint=pull_10.ClosestPoint, EndPoint=clean)
ln_16 = Line(StartPoint=pull_10.ClosestPoint, EndPoint=move_12.Geometry)
angle = Angle(VectorA=ln_16, VectorB=ln_15)  # -> Angle, Reflex
deg_3 = Degrees(Radians=angle.Angle)
flatten_11 = FlattenTree(Tree=deg_3, Path="{0}")
panel_38 = Panel(flatten_11)
c_script = CSharpScript(angle=flatten_11, minus=Slider(80, range=0..100))  # -> out, results; inputs angle: list of Double, minus: Double
# ---------- c_script: C# ----------
    List<double> MyAngle = new List<double>();
    for(int i = 0; i < angle.Count; i++){
      if (angle[i] > minus){
        angleEach = angle[i] - 90;
        Print("!!!!!!!!");
        MyAngle.Add(angleEach);
      }
      else{
        angleEach = angle[i];
        Print("00000");
        MyAngle.Add(angleEach);
      }

    }

    results = MyAngle;
# ---------- c_script: C# additional code ----------
  double angleEach = 0;
# ---------- end c_script ----------
larger_5 = LargerThan(FirstNumber=c_script.results, SecondNumber=Slider(30, range=0..100))  # -> LargerThan, OrEqualTo
panel_39 = Panel(c_script.results)
dispatch_18 = Dispatch(List=flatten(data_26), DispatchPattern=flatten(larger_5.LargerThan))  # -> ListA, ListB
data_27 = Data(dispatch_18.ListA)
deblock_7 = DeconstructBlock(Block=data_27)  # -> Name, Plane, Geometry
pln_13 = Plane(flatten(pln_6))
deplane_11 = DeconstructPlane(Plane=flatten(deblock_7.Plane))  # -> Origin, XAxis, YAxis, ZAxis
deplane_12 = DeconstructPlane(Plane=pln_13)  # -> Origin, XAxis, YAxis, ZAxis
testpoint_3 = TestPoint(archPoint=deplane_12.Origin, crvPoint=deplane_11.Origin)  # -> out, specialPt; inputs archPoint: list of Point3d, crvPoint: list of Point3d; same code as testpoint
cull_i_7 = CullIndex(List=pln_13, Indices=testpoint_3.specialPt, Wrap=True)
pln_14 = Plane(deblock_7.Plane)
crv_41 = Curve(crv_10)
pln_15 = Plane(cull_i_7)
data_28 = Data(flatten(pln_15))
deplane_13 = DeconstructPlane(Plane=data_28)  # -> Origin, XAxis, YAxis, ZAxis
amp_7 = Amplitude(Vector=deplane_13.YAxis, Amplitude=Slider(300, range=0..1000))
move_13 = Move(Geometry=deplane_13.Origin, Motion=amp_7)  # -> Geometry, Transform
ln_17 = Line(StartPoint=deplane_13.Origin, EndPoint=move_13.Geometry)
midpt_10 = CurveMiddle(Curve=ln_17)
scale_6 = Scale(Geometry=ln_17, Center=midpt_10, Factor=Slider(4.7, range=0..10))  # -> Geometry, Transform
ccx_7 = CurveCurve(CurveA=graft(scale_6.Geometry), CurveB=crv_41)  # -> flatten(Points), ParamsA, ParamsB
move2pt_6 = MoveToPoint(Geometry=data_28, PointA=deplane_13.Origin, PointB=ccx_7.Points)  # -> Moved, Vector, Transform

crv_42 = Curve(clscrv.Closed)
offset_11 = OffsetCurve(Curve=crv_42, Distance=expr("-x", number_slider_24), Corners=1)  # -> flatten(Curve)
pull_11 = PullPoint(Point=disc_5.Points, Geometry=offset_11, ClosestOnly=True)  # -> ClosestPoint, Distance
disc_9 = Discontinuity(Curve=offset_11, Level=1)  # -> Points, Parameters
pull_12 = PullPoint(Point=flatten(pull_11.ClosestPoint), Geometry=flatten(disc_9.Points), ClosestOnly=True)  # -> ClosestPoint, Distance
check_same_points = CheckSamePoints(archPoint=flatten(pull_11.ClosestPoint), crvPoint=flatten(pull_12.ClosestPoint))  # -> out, specialPt; inputs archPoint: list of Point3d, crvPoint: list of Point3d; same code as testpoint
cull_i_8 = CullIndex(List=flatten(disc_5.Points), Indices=check_same_points.specialPt, Wrap=True)
merge_10 = Merge(Data1=end_4.Start, Data2=end_4.End, Data3=cull_i_8)
check_same_points_2 = CheckSamePoints(archPoint=flatten(flatten_8), crvPoint=flatten(merge_10))  # -> out, specialPt; inputs archPoint: list of Point3d, crvPoint: list of Point3d; same code as testpoint
cull_i_9 = CullIndex(List=flatten(flatten_8), Indices=check_same_points_2.specialPt, Wrap=True)
pull_13 = PullPoint(Point=cull_i_9, Geometry=offset_11, ClosestOnly=True)  # -> ClosestPoint, Distance
ln_18 = Line(StartPoint=cull_i_9, EndPoint=pull_13.ClosestPoint)
rotate_3 = Rotate(Geometry=ln_18, Angle="Pi", Plane=cull_i_9)  # -> Geometry, Transform
# 阳角
# 阴角
rotate_4 = Rotate(Geometry=ln_18, Angle=1.570796327, Plane=cull_i_9)  # -> Geometry, Transform
# SmoothCurve-阳角
# SmoothCurve-阴角
# SmoothCurve-正常
# Angular Curve - All
# Special Curve(with location)- All
# Curve for this project only - All
pl_9 = ConstructPlane(Origin=cull_i_9, XAxis=rotate_3.Geometry, YAxis=rotate_4.Geometry)

crv_43 = Curve(clscrv.Closed)
offset_12 = OffsetCurve(Curve=crv_43, Distance=expr("-x", Slider(84, range=0..1000)), Corners=1)  # -> flatten(Curve)
pull_14 = PullPoint(Point=disc_6.Points, Geometry=offset_12, ClosestOnly=True)  # -> ClosestPoint, Distance
disc_10 = Discontinuity(Curve=offset_12, Level=1)  # -> Points, Parameters
pull_15 = PullPoint(Point=flatten(pull_14.ClosestPoint), Geometry=flatten(disc_10.Points), ClosestOnly=True)  # -> ClosestPoint, Distance
check_same_points_3 = CheckSamePoints(archPoint=flatten(pull_14.ClosestPoint), crvPoint=flatten(pull_15.ClosestPoint))  # -> out, specialPt; inputs archPoint: list of Point3d, crvPoint: list of Point3d; same code as testpoint
cull_i_10 = CullIndex(List=flatten(disc_6.Points), Indices=check_same_points_3.specialPt, Wrap=True)
merge_11 = Merge(Data1=end_5.Start, Data2=end_5.End, Data3=cull_i_10)
check_same_points_4 = CheckSamePoints(archPoint=flatten(flatten_9), crvPoint=flatten(merge_11))  # -> out, specialPt; inputs archPoint: list of Point3d, crvPoint: list of Point3d; same code as testpoint
cull_i_11 = CullIndex(List=flatten(flatten_9), Indices=check_same_points_4.specialPt, Wrap=True)
pull_16 = PullPoint(Point=cull_i_11, Geometry=offset_12, ClosestOnly=True)  # -> ClosestPoint, Distance
ln_19 = Line(StartPoint=cull_i_11, EndPoint=pull_16.ClosestPoint)
rotate_5 = Rotate(Geometry=ln_19, Angle="Pi", Plane=cull_i_11)  # -> Geometry, Transform
rotate_6 = Rotate(Geometry=rotate_5.Geometry, Angle=-1.570796327, Plane=cull_i_11)  # -> Geometry, Transform
pl_10 = ConstructPlane(Origin=cull_i_11, XAxis=rotate_5.Geometry, YAxis=rotate_6.Geometry)

# ----
# 阳角
item_23 = ListItem(List=data_25, Index=testpoint_2.specialPt, Wrap=True)

# ----
# 阴角
cull_i_12 = CullIndex(List=data_25, Indices=testpoint_2.specialPt, Wrap=True)

dist_3 = Distance(PointA=graft(deplane_11.Origin), PointB=item_23)
sort_8 = SortList(Keys=dist_3)  # -> Keys, ValuesA
item_24 = ListItem(List=sort_8.Keys, Index=0, Wrap=True)
flatten_12 = FlattenTree(Tree=item_24, Path="{0}")
smaller_4 = SmallerThan(FirstNumber=item_24, SecondNumber=Slider(100, range=0..300))  # -> SmallerThan, OrEqualTo
panel_40 = Panel(flatten_12)
dispatch_19 = Dispatch(List=graft(pln_14), DispatchPattern=smaller_4.SmallerThan)  # -> ListA, ListB
data_29 = Data(flatten(dispatch_19.ListA))
data_30 = Data(flatten(dispatch_19.ListB))
deplane_14 = DeconstructPlane(Plane=data_29)  # -> Origin, XAxis, YAxis, ZAxis
deplane_15 = DeconstructPlane(Plane=data_30)  # -> Origin, XAxis, YAxis, ZAxis
amp_8 = Amplitude(Vector=deplane_14.YAxis, Amplitude=Slider(300, range=0..1000))
amp_9 = Amplitude(Vector=deplane_15.YAxis, Amplitude=Slider(300, range=0..1000))
move_14 = Move(Geometry=deplane_14.Origin, Motion=amp_8)  # -> Geometry, Transform
move_15 = Move(Geometry=deplane_15.Origin, Motion=amp_9)  # -> Geometry, Transform
ln_20 = Line(StartPoint=deplane_14.Origin, EndPoint=move_14.Geometry)
ln_21 = Line(StartPoint=deplane_15.Origin, EndPoint=move_15.Geometry)
midpt_11 = CurveMiddle(Curve=ln_20)
midpt_12 = CurveMiddle(Curve=ln_21)
scale_7 = Scale(Geometry=ln_20, Center=midpt_11, Factor=Slider(1.5, range=0..10))  # -> Geometry, Transform
scale_8 = Scale(Geometry=ln_21, Center=midpt_12, Factor=Slider(1.5, range=0..10))  # -> Geometry, Transform
ccx_8 = CurveCurve(CurveA=graft(scale_7.Geometry), CurveB=crv_41)  # -> flatten(Points), ParamsA, ParamsB
ccx_9 = CurveCurve(CurveA=graft(scale_8.Geometry), CurveB=crv_41)  # -> flatten(Points), ParamsA, ParamsB
move2pt_7 = MoveToPoint(Geometry=data_29, PointA=deplane_14.Origin, PointB=ccx_8.Points)  # -> Moved, Vector, Transform
move2pt_8 = MoveToPoint(Geometry=data_30, PointA=deplane_15.Origin, PointB=ccx_9.Points)  # -> Moved, Vector, Transform

clscrv_2 = CloseCurve(Curve=crv_13, CloseType=0, Bulge=0.5, Tolerance=0)  # -> Closed, R
crv_44 = Curve(crv_10)
disc_11 = Discontinuity(Curve=graft(crv_44), Level=1)  # -> Points, Parameters
crv_cp_7 = CurveClosestPoint(Point=disc_11.Points, Curve=graft(crv_44))  # -> Point, Parameter, Distance
eval_5 = EvaluateCurve(Curve=graft(crv_44), Parameter=crv_cp_7.Parameter)  # -> flatten(Point), Tangent, flatten(Angle)
deg_4 = Degrees(Radians=eval_5.Angle)
offset_13 = OffsetCurve(Curve=clscrv_2.Closed, Distance=expr("-X", Slider(300, range=0..1000)), Corners=1)
panel_41 = Panel(deg_4)
larger_6 = LargerThan(FirstNumber=deg_4, SecondNumber=Slider(60, range=0..100))  # -> LargerThan, OrEqualTo
disc_12 = Discontinuity(Curve=offset_13, Level=1)  # -> flatten(Points), Parameters
dispatch_20 = Dispatch(List=eval_5.Point, DispatchPattern=larger_6.LargerThan)  # -> ListA, ListB
data_31 = Data(dispatch_20.ListA)
pull_17 = PullPoint(Point=data_31, Geometry=flatten(offset_13), ClosestOnly=True)  # -> ClosestPoint, Distance
testpoint_4 = TestPoint(archPoint=pull_17.ClosestPoint, crvPoint=disc_12.Points)  # -> out, specialPt; inputs archPoint: list of Point3d, crvPoint: list of Point3d; same code as testpoint
pull_18 = PullPoint(Point=flatten(pln_12), Geometry=crv_44, ClosestOnly=True)  # -> ClosestPoint, Distance
pull_19 = PullPoint(Point=pull_18.ClosestPoint, Geometry=data_31, ClosestOnly=True)  # -> ClosestPoint, Distance
flatten_13 = FlattenTree(Tree=data_21, Path="{0}")
sort_9 = SortList(Keys=pull_19.Distance, ValuesA=flatten_13)  # -> Keys, ValuesA
panel_42 = Panel(sort_9.Keys)
smaller_5 = SmallerThan(FirstNumber=sort_9.Keys, SecondNumber=Slider(100, range=0..100))  # -> SmallerThan, OrEqualTo
dispatch_21 = Dispatch(List=sort_9.ValuesA, DispatchPattern=smaller_5.SmallerThan)  # -> ListA, ListB
data_32 = Data(dispatch_21.ListA)
deblock_8 = DeconstructBlock(Block=data_32)  # -> Name, Plane, Geometry
deplane_16 = DeconstructPlane(Plane=deblock_8.Plane)  # -> Origin, XAxis, YAxis, ZAxis
pt_27 = Point(data_31)
pull_20 = PullPoint(Point=deplane_16.Origin, Geometry=pt_27, ClosestOnly=True)  # -> ClosestPoint, Distance
cir_3 = Circle(Plane=pull_20.ClosestPoint, Radius=Slider(300, range=0..1000))
crv_45 = Curve(crv_44)
amp_10 = Amplitude(Vector=deplane_16.YAxis, Amplitude=Slider(200, range=0..1000))
ccx_10 = CurveCurve(CurveA=cir_3, CurveB=crv_45)  # -> Points, ParamsA, ParamsB
move_16 = Move(Geometry=pull_20.ClosestPoint, Motion=amp_10)  # -> Geometry, Transform
item_25 = ListItem(List=ccx_10.Points, Index=0, Wrap=True)
clean_2 = CleanTree(RemoveNulls=True, RemoveInvalid=True, RemoveEmpty=Toggle(True), Tree=item_25)
item_26 = ListItem(List=data_31, Index=testpoint_4.specialPt, Wrap=True)
cull_i_13 = CullIndex(List=data_31, Indices=testpoint_4.specialPt, Wrap=True)
ln_22 = Line(StartPoint=pull_20.ClosestPoint, EndPoint=clean_2)
ln_23 = Line(StartPoint=pull_20.ClosestPoint, EndPoint=move_16.Geometry)
angle_2 = Angle(VectorA=ln_23, VectorB=ln_22)  # -> Angle, Reflex
deg_5 = Degrees(Radians=angle_2.Angle)
flatten_14 = FlattenTree(Tree=deg_5, Path="{0}")
panel_43 = Panel(flatten_14)
c_script_2 = CSharpScript(angle=flatten_14, minus=Slider(80, range=0..100))  # -> out, results; inputs angle: list of Double, minus: Double; same code as c_script
larger_7 = LargerThan(FirstNumber=c_script_2.results, SecondNumber=Slider(30, range=0..100))  # -> LargerThan, OrEqualTo
panel_44 = Panel(c_script_2.results)
dispatch_22 = Dispatch(List=flatten(data_32), DispatchPattern=flatten(larger_7.LargerThan))  # -> ListA, ListB
data_33 = Data(dispatch_22.ListA)
deblock_9 = DeconstructBlock(Block=data_33)  # -> Name, Plane, Geometry
pln_16 = Plane(flatten(pln_12))
deplane_17 = DeconstructPlane(Plane=flatten(deblock_9.Plane))  # -> Origin, XAxis, YAxis, ZAxis
deplane_18 = DeconstructPlane(Plane=pln_16)  # -> Origin, XAxis, YAxis, ZAxis
testpoint_5 = TestPoint(archPoint=deplane_18.Origin, crvPoint=deplane_17.Origin)  # -> out, specialPt; inputs archPoint: list of Point3d, crvPoint: list of Point3d; same code as testpoint
cull_i_14 = CullIndex(List=pln_16, Indices=testpoint_5.specialPt, Wrap=True)
pln_17 = Plane(deblock_9.Plane)
dist_4 = Distance(PointA=graft(deplane_17.Origin), PointB=item_26)
sort_10 = SortList(Keys=dist_4)  # -> Keys, ValuesA
item_27 = ListItem(List=sort_10.Keys, Index=0, Wrap=True)
flatten_15 = FlattenTree(Tree=item_27, Path="{0}")
smaller_6 = SmallerThan(FirstNumber=item_27, SecondNumber=Slider(100, range=0..300))  # -> SmallerThan, OrEqualTo
panel_45 = Panel(flatten_15)
dispatch_23 = Dispatch(List=graft(pln_17), DispatchPattern=smaller_6.SmallerThan)  # -> ListA, ListB
crv_46 = Curve(crv_10)
pln_18 = Plane(cull_i_14)

data_34 = Data(flatten(dispatch_23.ListB))
deplane_19 = DeconstructPlane(Plane=data_34)  # -> Origin, XAxis, YAxis, ZAxis
amp_11 = Amplitude(Vector=deplane_19.YAxis, Amplitude=Slider(300, range=0..1000))
move_17 = Move(Geometry=deplane_19.Origin, Motion=amp_11)  # -> Geometry, Transform
ln_24 = Line(StartPoint=deplane_19.Origin, EndPoint=move_17.Geometry)
midpt_13 = CurveMiddle(Curve=ln_24)
scale_9 = Scale(Geometry=ln_24, Center=midpt_13, Factor=Slider(1.5, range=0..10))  # -> Geometry, Transform
ccx_11 = CurveCurve(CurveA=graft(scale_9.Geometry), CurveB=crv_46)  # -> flatten(Points), ParamsA, ParamsB

data_35 = Data(flatten(dispatch_23.ListA))
deplane_20 = DeconstructPlane(Plane=data_35)  # -> Origin, XAxis, YAxis, ZAxis
amp_12 = Amplitude(Vector=deplane_20.YAxis, Amplitude=Slider(300, range=0..1000))
move_18 = Move(Geometry=deplane_20.Origin, Motion=amp_12)  # -> Geometry, Transform
ln_25 = Line(StartPoint=deplane_20.Origin, EndPoint=move_18.Geometry)
midpt_14 = CurveMiddle(Curve=ln_25)
scale_10 = Scale(Geometry=ln_25, Center=midpt_14, Factor=Slider(1.5, range=0..10))  # -> Geometry, Transform
ccx_12 = CurveCurve(CurveA=graft(scale_10.Geometry), CurveB=crv_46)  # -> flatten(Points), ParamsA, ParamsB

data_36 = Data(flatten(pln_18))
deplane_21 = DeconstructPlane(Plane=data_36)  # -> Origin, XAxis, YAxis, ZAxis
amp_13 = Amplitude(Vector=deplane_21.YAxis, Amplitude=Slider(300, range=0..1000))
move_19 = Move(Geometry=deplane_21.Origin, Motion=amp_13)  # -> Geometry, Transform
ln_26 = Line(StartPoint=deplane_21.Origin, EndPoint=move_19.Geometry)
midpt_15 = CurveMiddle(Curve=ln_26)
scale_11 = Scale(Geometry=ln_26, Center=midpt_15, Factor=Slider(4.7, range=0..10))  # -> Geometry, Transform
ccx_13 = CurveCurve(CurveA=graft(scale_11.Geometry), CurveB=crv_46)  # -> flatten(Points), ParamsA, ParamsB

move2pt_9 = MoveToPoint(Geometry=data_36, PointA=deplane_21.Origin, PointB=ccx_13.Points)  # -> Moved, Vector, Transform
move2pt_10 = MoveToPoint(Geometry=data_35, PointA=deplane_20.Origin, PointB=ccx_12.Points)  # -> Moved, Vector, Transform
move2pt_11 = MoveToPoint(Geometry=data_34, PointA=deplane_19.Origin, PointB=ccx_11.Points)  # -> Moved, Vector, Transform
xy_19 = XYPlane(Origin=move2pt_9.Moved)
xy_20 = XYPlane(Origin=move2pt_10.Moved)
xy_21 = XYPlane(Origin=move2pt_11.Moved)
rotate_7 = Rotate(Geometry=move2pt_9.Moved, Angle="Pi", Plane=xy_19)  # -> Geometry, Transform
rotate_8 = Rotate(Geometry=move2pt_10.Moved, Angle="Pi", Plane=xy_20)  # -> Geometry, Transform
rotate_9 = Rotate(Geometry=move2pt_11.Moved, Angle="Pi", Plane=xy_21)  # -> Geometry, Transform
filter_19 = StreamFilter(Gate=Toggle(True), Stream0=move2pt_10.Moved, Stream1=rotate_8.Geometry)
# SmoothCurve-阴角
filter_20 = StreamFilter(Gate=Toggle(True), Stream0=move2pt_11.Moved, Stream1=rotate_9.Geometry)
filter_21 = StreamFilter(Gate=Toggle(True), Stream0=move2pt_9.Moved, Stream1=rotate_7.Geometry)

dist_5 = Distance(PointA=pull_6.ClosestPoint, PointB=data_25)
sort_11 = SortList(Keys=dist_5)  # -> Keys, ValuesA
panel_46 = Panel(sort_11.Keys)
smaller_7 = SmallerThan(FirstNumber=dist_5, SecondNumber=Slider(200, range=0..1000))  # -> SmallerThan, OrEqualTo
dispatch_24 = Dispatch(List=geo_6, DispatchPattern=smaller_7.SmallerThan)  # -> ListA, ListB
data_37 = Data(dispatch_24.ListB)
explode_7 = Explode(Curve=data_37, Recursive=True)  # -> Segments, Vertices
len_4 = Length(Curve=explode_7.Segments)
sort_12 = SortList(Keys=reverse(len_4), ValuesA=explode_7.Segments)  # -> Keys, ValuesA
item_28 = ListItem(List=sort_12.ValuesA, Index=0, Wrap=True)  # -> flatten(Item)
area_7 = Area(Geometry=data_37)  # -> Area, Centroid
midpt_16 = CurveMiddle(Curve=item_28)
move2pt_12 = MoveToPoint(Geometry=item_28, PointA=midpt_16, PointB=area_7.Centroid)  # -> Moved, Vector, Transform
end_6 = EndPoints(Curve=move2pt_12.Moved)  # -> Start, End
pull_21 = PullPoint(Point=end_6.Start, Geometry=crv_35, ClosestOnly=True)  # -> ClosestPoint, Distance
crv_cp_8 = CurveClosestPoint(Point=graft(pull_21.ClosestPoint), Curve=crv_35)  # -> Point, Parameter, Distance
eval_6 = EvaluateCurve(Curve=crv_35, Parameter=crv_cp_8.Parameter)  # -> Point, Tangent, Angle
pull_22 = PullPoint(Point=eval_6.Point, Geometry=pull_21.ClosestPoint, ClosestOnly=True)  # -> ClosestPoint, Distance
sort_13 = SortList(Keys=pull_22.Distance, ValuesA=eval_6.Point)  # -> Keys, ValuesA
sort_14 = SortList(Keys=pull_22.Distance, ValuesA=eval_6.Tangent)  # -> Keys, ValuesA
item_29 = ListItem(List=sort_14.ValuesA, Index="0", Wrap=True)
# 阳角
item_30 = ListItem(List=sort_13.ValuesA, Index="0", Wrap=True)
# 阴角
amp_14 = Amplitude(Vector=item_29, Amplitude=Slider(100, range=0..100))
move_20 = Move(Geometry=item_30, Motion=amp_14)  # -> Geometry, Transform
xy_22 = XYPlane(Origin=item_30)
rotate_10 = Rotate(Geometry=move_20.Geometry, Angle="1 * Pi", Plane=xy_22)  # -> Geometry, Transform
ln_27 = Line(StartPoint=item_30, EndPoint=rotate_10.Geometry)
rotate_11 = Rotate(Geometry=ln_27, Angle=filter_18, Plane=xy_22)  # -> Geometry, Transform
pl_11 = ConstructPlane(Origin=move_20.Geometry, XAxis=ln_27, YAxis=rotate_11.Geometry)

# ----
# 转角点
data_38 = Data(dispatch_24.ListA)

explode_8 = Explode(Curve=data_38, Recursive=True)  # -> Segments, Vertices
len_5 = Length(Curve=explode_8.Segments)
sort_15 = SortList(Keys=reverse(len_5), ValuesA=explode_8.Segments)  # -> Keys, ValuesA
item_31 = ListItem(List=sort_15.ValuesA, Index=0, Wrap=True)  # -> flatten(Item)
area_8 = Area(Geometry=data_38)  # -> Area, Centroid
midpt_17 = CurveMiddle(Curve=item_31)
move2pt_13 = MoveToPoint(Geometry=item_31, PointA=midpt_17, PointB=area_8.Centroid)  # -> Moved, Vector, Transform
end_7 = EndPoints(Curve=move2pt_13.Moved)  # -> Start, End
ln_28 = Line(StartPoint=end_7.Start, EndPoint=end_7.End)
xy_23 = XYPlane(Origin=end_7.End)
rotate_12 = Rotate(Geometry=ln_28, Angle=filter_17, Plane=xy_23)  # -> Geometry, Transform
pl_12 = ConstructPlane(Origin=end_7.End, XAxis=rotate_12.Geometry, YAxis=ln_28)
dist_6 = Distance(PointA=graft(end_7.End), PointB=item_23)
sort_16 = SortList(Keys=dist_6)  # -> Keys, ValuesA
item_32 = ListItem(List=sort_16.Keys, Index=0, Wrap=True)
smaller_8 = SmallerThan(FirstNumber=item_32, SecondNumber=Slider(100, range=0..300))  # -> SmallerThan, OrEqualTo
flatten_16 = FlattenTree(Tree=item_32, Path="{0}")
dispatch_25 = Dispatch(List=graft(pl_12), DispatchPattern=smaller_8.SmallerThan)  # -> ListA, ListB
panel_47 = Panel(flatten_16)
data_39 = Data(flatten(dispatch_25.ListA))
data_40 = Data(flatten(dispatch_25.ListB))
deplane_22 = DeconstructPlane(Plane=data_39)  # -> Origin, XAxis, YAxis, ZAxis
deplane_23 = DeconstructPlane(Plane=data_40)  # -> Origin, XAxis, YAxis, ZAxis
amp_15 = Amplitude(Vector=deplane_22.YAxis, Amplitude=Slider(300, range=0..1000))
amp_16 = Amplitude(Vector=deplane_23.YAxis, Amplitude=Slider(300, range=0..1000))
move_21 = Move(Geometry=deplane_22.Origin, Motion=amp_15)  # -> Geometry, Transform
move_22 = Move(Geometry=deplane_23.Origin, Motion=amp_16)  # -> Geometry, Transform
ln_29 = Line(StartPoint=deplane_22.Origin, EndPoint=move_21.Geometry)
ln_30 = Line(StartPoint=deplane_23.Origin, EndPoint=move_22.Geometry)
midpt_18 = CurveMiddle(Curve=ln_29)
midpt_19 = CurveMiddle(Curve=ln_30)
scale_12 = Scale(Geometry=ln_29, Center=midpt_18, Factor=Slider(1.5, range=0..10))  # -> Geometry, Transform
scale_13 = Scale(Geometry=ln_30, Center=midpt_19, Factor=Slider(1.5, range=0..10))  # -> Geometry, Transform
ccx_14 = CurveCurve(CurveA=graft(scale_13.Geometry), CurveB=crv_36)  # -> flatten(Points), ParamsA, ParamsB
ccx_15 = CurveCurve(CurveA=graft(scale_12.Geometry), CurveB=crv_36)  # -> flatten(Points), ParamsA, ParamsB
move2pt_14 = MoveToPoint(Geometry=data_39, PointA=deplane_22.Origin, PointB=ccx_15.Points)  # -> Moved, Vector, Transform
move2pt_15 = MoveToPoint(Geometry=data_40, PointA=deplane_23.Origin, PointB=ccx_14.Points)  # -> Moved, Vector, Transform

# ----
# 阴阳角
number_slider_25 = Slider(1000, range=0..1000)
cir_4 = Circle(Plane=move2pt_7.Moved, Radius=number_slider_25)
cir_5 = Circle(Plane=move2pt_8.Moved, Radius=number_slider_25)
cir_6 = Circle(Plane=filter_19, Radius=1)
cir_7 = Circle(Plane=filter_19, Radius=number_slider_25)
cir_8 = Circle(Plane=move2pt_14.Moved, Radius=number_slider_25)
cir_9 = Circle(Plane=move2pt_15.Moved, Radius=number_slider_25)
merge_12 = Merge(Data1=cir_4, Data2=cir_5, Data3=cir_6, Data4=cir_7, Data5=cir_8, Data6=cir_9)

# ----
# SIte-所有的定位点
merge_13 = Merge(Data1=move2pt_6.Moved, Data2=filter_21, Data3=pl_11, Data4=pl_10, Data5=pl_3, Data6=pl_9)  # -> flatten(Result)

# ---- group: Monomer + Side/Top / Monomer Type
filter_22 = StreamFilter(Gate=list, Stream0=item_18, Stream1=item_18, Stream2=item_18)

# ----
# 槽埋-角部倾斜时
bbox_4 = BoundingBox(Content=item_18, Plane=PlaneXY(0, 0, 0))  # -> Box, Box_2
ln_31 = Line(StartPoint=pt_24, EndPoint=pt_25)
debrep = DeconstructBrep(Brep=bbox_4.Box)  # -> Faces, Edges, Vertices
deplane_24 = DeconstructPlane(Plane=ln_31)  # -> Origin, XAxis, YAxis, ZAxis
len_6 = Length(Curve=debrep.Edges)
sort_17 = SortList(Keys=len_6, ValuesA=debrep.Edges)  # -> Keys, reverse(ValuesA)
amp_17 = Amplitude(Vector=deplane_24.XAxis, Amplitude=Slider(63.5, range=10..100))
item_33 = ListItem(List=sort_17.ValuesA, Index=0, Wrap=True)  # -> Item, Item1, Item2
item_34 = ListItem(List=sort_17.ValuesA, Index=0, Wrap=True)
move_23 = Move(Geometry=deplane_24.Origin, Motion=amp_17)  # -> Geometry, Transform
len_7 = Length(Curve=item_34)
end_8 = EndPoints(Curve=item_33.Item2)  # -> Start, End
end_9 = EndPoints(Curve=item_33.Item1)  # -> Start, End
ln_32 = Line(StartPoint=deplane_24.Origin, EndPoint=move_23.Geometry)
ln_33 = Line(StartPoint=move_23.Geometry, EndPoint=deplane_24.Origin)
avr = Average(Input=[end_9.Start, end_9.End])
ln_34 = Line(StartPoint=end_8.Start, EndPoint=end_8.End)
ln_35 = Line(StartPoint=end_9.Start, EndPoint=avr)
c_script_3 = CSharpScript(iReset=Toggle(True), turns=Slider(30, range=0..100), steps=Slider(10, range=0..10))  # -> out, num; inputs numDefault: Double, iReset: Boolean, turns: Int32, steps: Double
# ---------- c_script_3: C# ----------
    if(iReset){
      number = 0;}

    for(int i = 0; i < turns;i++){
      number = number + steps;
      numStore.Add(number);
      Print(number.ToString());}

    num = numStore;
# ---------- c_script_3: C# additional code ----------
  double number = 0;
  List <double> numStore = new List<double>();
# ---------- end c_script_3 ----------
pl_13 = ConstructPlane(Origin=avr, XAxis=ln_35, YAxis=ln_34)
panel_48 = Panel(c_script_3.num)
amp_18 = Amplitude(Vector=ln_31, Amplitude=graft(c_script_3.num))

item_35 = ListItem(List=flatten(len_7), Index=0, Wrap=True)

ln_36 = Line(StartPoint=pt_24, EndPoint=pt_25)
move_24 = Move(Geometry=pt_25, Motion=ln_36)  # -> Geometry, Transform
ccx_16 = CurveCurve(CurveA=cir)  # -> Points, ParamsA, ParamsB
item_36 = ListItem(List=ccx_16.Points, Index=0, Wrap=True)  # -> flatten(Item), flatten(Item1)
ln_37 = Line(StartPoint=pt_25, EndPoint=item_36.Item)
ln_38 = Line(StartPoint=pt_25, EndPoint=move_24.Geometry)
ln_39 = Line(StartPoint=pt_25, EndPoint=item_36.Item1)
angle_3 = Angle(VectorA=ln_37, VectorB=ln_38)  # -> Angle, Reflex
angle_4 = Angle(VectorA=ln_39, VectorB=ln_38)  # -> Angle, Reflex
deg_6 = Degrees(Radians=angle_3.Angle)
deg_7 = Degrees(Radians=angle_4.Angle)
item_37 = ListItem(List=ln_38, Index=Slider(3, range=0..4), Wrap=True)
tan = Tangent(Value=degrees(deg_6))
entwine_12 = Entwine(Branch00=ln_37, Branch01=tan, FlattenInputs=True)
tan_2 = Tangent(Value=degrees(deg_7))
division_7 = Division(A=tan, B=tan_2)
panel_49 = Panel(deg_7)
panel_50 = Panel(deg_6)
addition_5 = Addition(A=division_7, B=1)
division_8 = Division(A="1", B=addition_5)
subtraction = Subtraction(A="1", B=division_8)
num = Number(division_8)
larger_8 = LargerThan(FirstNumber=tan, SecondNumber=tan_2)  # -> LargerThan, OrEqualTo

amp_19 = Amplitude(Vector=ln_33, Amplitude=expr("x/2", flatten(item_35)))
amp_20 = Amplitude(Vector=ln_32, Amplitude=expr("x/2", flatten(item_35)))
move_25 = Move(Geometry=pt_25, Motion=amp_19)  # -> Geometry, Transform
move_26 = Move(Geometry=pt_25, Motion=amp_20)  # -> Geometry, Transform
ln_40 = Line(StartPoint=move_25.Geometry, EndPoint=move_26.Geometry)

crv_47 = Curve(ln_40)
mp = Midpoint(Curve=crv_47)
eval_7 = EvaluateCurve(Curve=crv_47, Parameter=subtraction)  # -> Point, Tangent, Angle
eval_8 = EvaluateCurve(Curve=crv_47, Parameter=num)  # -> Point, Tangent, Angle
dispatch_26 = Dispatch(List=eval_7.Point, DispatchPattern=larger_8.OrEqualTo)  # -> ListA, ListB
dispatch_27 = Dispatch(List=eval_8.Point, DispatchPattern=larger_8.OrEqualTo)  # -> ListA, ListB
pt_28 = Point(dispatch_26.ListB)
pt_29 = Point(dispatch_27.ListA)
merge_14 = Merge(Data1=pt_29, Data2=pt_28)
pull_23 = PullPoint(Point=merge_14, Geometry=graft(mp), ClosestOnly=True)  # -> ClosestPoint, Distance
panel_51 = Panel(merge_14)
sort_18 = SortList(Keys=pull_23.Distance, ValuesA=merge_14)  # -> Keys, ValuesA
item_38 = ListItem(List=sort_18.ValuesA, Index=0, Wrap=True)  # -> flatten(Item)
ln_41 = Line(StartPoint=item_38, EndPoint=mp)
panel_52 = Panel(item_38)
move_27 = Move(Geometry=crv_47, Motion=ln_41)  # -> Geometry, Transform

# ---- group: 正常和阳角 - BoundingBox — 测Intersection
entwine_13 = Entwine(FlattenInputs=True)
flip_3 = FlipMatrix(Data=entwine_13)
item_39 = ListItem(List=flip_3, Index=0, Wrap=True)  # -> Item, Item1

# ----
move_28 = Move(Geometry=move_27.Geometry, Motion=amp_18)  # -> Geometry, Transform
ccx_17 = CurveCurve(CurveA=move_28.Geometry, CurveB=crv_16)  # -> Points, ParamsA, ParamsB
item_40 = ListItem(List=ccx_17.Points, Index=0, Wrap=True)
item_41 = ListItem(List=ccx_17.Points, Index="-1", Wrap=True)
pshift_6 = ShiftPaths(Data=item_40, Offset=-1)
pshift_7 = ShiftPaths(Data=item_41, Offset=-1)
flip_4 = FlipMatrix(Data=pshift_6)
flip_5 = FlipMatrix(Data=pshift_7)
pt_30 = Point(flip_4)
pt_31 = Point(flip_5)
pull_24 = PullPoint(Point=pt_30, Geometry=graft(mp), ClosestOnly=True)  # -> ClosestPoint, Distance
pull_25 = PullPoint(Point=pt_31, Geometry=graft(mp), ClosestOnly=True)  # -> ClosestPoint, Distance
sort_19 = SortList(Keys=pull_24.Distance, ValuesA=pt_30)  # -> Keys, ValuesA
sort_20 = SortList(Keys=pull_25.Distance, ValuesA=pt_31)  # -> Keys, ValuesA
item_42 = ListItem(List=sort_19.ValuesA, Index="-1", Wrap=True)
item_43 = ListItem(List=sort_20.ValuesA, Index="-1", Wrap=True)
ln_42 = Line(StartPoint=item_43, EndPoint=item_42)

end_10 = EndPoints(Curve=ln_42)  # -> Start, End

avr_2 = Average(Input=[end_10.Start, end_10.End])
pl_14 = ConstructPlane(Origin=avr_2, XAxis=ln_42, YAxis=graft(ln_31))
orient_6 = Orient(Geometry=graft(item_19), Source=pl_13, Target=pl_14)  # -> Geometry, Transform
orient_7 = Orient(Geometry=graft(item_18), Source=pl_13, Target=pl_14)  # -> Geometry, Transform

filter_23 = StreamFilter(Gate=list_8, Stream0=item_18, Stream1=orient_7.Geometry)

# ---- group: Monomer + Side/Top / Monomer Type (continued)
filter_24 = StreamFilter(Gate=list, Stream0=item_18, Stream1=filter_23, Stream2=item_18)

# ---- group: Monomer + Side/Top / Top/Side
filter_25 = StreamFilter(Gate=list_2, Stream0=filter_24, Stream1=filter_22)

# ----
filter_26 = StreamFilter(Gate=list_8, Stream0=item_19, Stream1=orient_6.Geometry)

# ---- group: 阳角分类
filter_27 = StreamFilter(Gate=list, Stream0=item_19, Stream1=filter_26, Stream2=item_19)
filter_28 = StreamFilter(Gate=list, Stream0=item_19, Stream1=item_19, Stream2=item_19)
filter_29 = StreamFilter(Gate=list_2, Stream0=filter_27, Stream1=filter_28)

# ----
阳角 = Geometry(filter_29)

# ---- group: 正常和阳角 - BoundingBox — 测Intersection (continued)
c_script_4 = CSharpScript(BrepMain=item_20, BrepStay=filter_25)  # -> out, BrepInters, BrepRemain, IndexM, IndexS; inputs BrepMain: list of Brep, BrepStay: list of Brep
# ---------- c_script_4: C# ----------
    List<Brep> BrepI = new List<Brep>();
    List<Brep> BrepR = new List<Brep>();
    List<int> num = new List<int>();
    List<int> numS = new List<int>();


    double tolr = Rhino.RhinoDoc.ActiveDoc.ModelAbsoluteTolerance;

    for(int j = 0; j < BrepMain.Count;j++){
      for(int i = 0; i < BrepStay.Count;i++){
        bool test = Rhino.Geometry.Intersect.Intersection.BrepBrep(BrepMain[j], BrepStay[i], tolr, out crv, out pts);
        if(test && crv.Length != 0){
          tryThis = true;
          numS.Add(i);
          break;}
        else{
          tryThis = false;}
      }
      if(tryThis){
        BrepI.Add(BrepMain[j]);
        num.Add(j);
      }
      else{
        BrepR.Add(BrepMain[j]);
      }
    }



    BrepInters = BrepI;
    BrepRemain = BrepR;
    IndexM = num;
    IndexS = numS;
# ---------- c_script_4: C# additional code ----------
  Rhino.Geometry.Curve[] crv;
  Rhino.Geometry.Point3d[] pts;
  bool tryThis;
# ---------- end c_script_4 ----------
item_44 = ListItem(List=item_20, Index=c_script_4.IndexM, Wrap=True)  # -> graft(Item)
item_45 = ListItem(List=filter_25, Index=c_script_4.IndexS, Wrap=True)  # -> graft(Item)
cull_i_15 = CullIndex(List=item_21, Indices=c_script_4.IndexM, Wrap=True)
item_46 = ListItem(List=item_21, Index=c_script_4.IndexM, Wrap=True)  # -> graft(Item)
area_9 = Area(Geometry=item_44)  # -> Area, Centroid
bbx = BrepBrep(BrepA=item_44, BrepB=item_45)  # -> simplify(Curves), Points
area_10 = Area(Geometry=bbx.Curves)  # -> Area, Centroid
ln_43 = Line(StartPoint=area_9.Centroid, EndPoint=area_10.Centroid)
mp_2 = Midpoint(Curve=ln_43)
scale_14 = Scale(Geometry=ln_43, Center=mp_2, Factor=Slider(1000000, range=0..1000000))  # -> Geometry, Transform
ccx_18 = CurveCurve(CurveA=scale_14.Geometry, CurveB=bbx.Curves)  # -> Points, ParamsA, ParamsB
item_47 = ListItem(List=ccx_18.Points, Index=0, Wrap=True)  # -> Item, Item1
ln_44 = Line(StartPoint=item_47.Item1, EndPoint=item_47.Item)
move_29 = Move(Geometry=item_46, Motion=ln_44)  # -> simplify(Geometry), Transform
bbox_5 = BoundingBox(Content=move_29.Geometry, Plane=PlaneXY(0, 0, 0))  # -> Box, Box_2

# ----
# 这里如果跑红也不要紧，
# 说明单体没有出现相撞的情况
area_11 = Area(Geometry=bbox_5.Box)  # -> Area, Centroid

# ---- group: 正常和阳角 - BoundingBox — 测Intersection (continued)
entwine_14 = Entwine(Branch00=move_29.Geometry, Branch01=area_11.Centroid, FlattenInputs=True)
flip_6 = FlipMatrix(Data=entwine_14)
item_48 = ListItem(List=flip_6, Index="0", Wrap=True)  # -> flatten(Item)
item_49 = ListItem(List=flip_6, Index="-1", Wrap=True)  # -> flatten(Item)
pull_26 = PullPoint(Point=item_49, Geometry=item_39.Item, ClosestOnly=True)  # -> flatten(ClosestPoint), Distance
pull_27 = PullPoint(Point=item_49, Geometry=item_39.Item1, ClosestOnly=True)  # -> flatten(ClosestPoint), Distance
vec2pt_4 = Vector2Pt(PointA=item_49, PointB=pull_26.ClosestPoint, Unitize=False)  # -> Vector, Length
vec2pt_5 = Vector2Pt(PointA=item_49, PointB=pull_27.ClosestPoint, Unitize=False)  # -> Vector, Length
multiplication_7 = Multiplication(A=vec2pt_4.Vector, B=vec2pt_5.Vector)
larger_9 = LargerThan(FirstNumber=multiplication_7, SecondNumber=0)  # -> LargerThan, OrEqualTo
dispatch_28 = Dispatch(List=item_48, DispatchPattern=larger_9.LargerThan)  # -> ListA, ListB

# ---- group: Normal
geo_7 = Geometry(cull_i_15)

# ---- group: Normal-Move
移动 = Geometry(dispatch_28.ListA)

# ----
# PLAN Results
merge_15 = Merge(Data1=geo_7, Data2=阳角, Data3=移动, Data4=阴角)

# ----
# 1.是否有檐口线
toggle_4 = BooleanToggle(True)
clean_3 = CleanTree(RemoveNulls=True, RemoveInvalid=True, RemoveEmpty=toggle_4, Tree=merge_13)
crv_48 = Curve(crv_6)
deplane_25 = DeconstructPlane(Plane=clean_3)  # -> Origin, XAxis, YAxis, ZAxis
incurve = PointInCurve(Point=deplane_25.Origin, Curve=crv_48)  # -> Relationship, Point
equals_3 = Equality(FirstNumber=incurve.Relationship, SecondNumber="2")  # -> Equality, Inequality
dispatch_29 = Dispatch(List=clean_3, DispatchPattern=equals_3.Equality)  # -> ListA, ListB
crv_49 = Curve(crv_7)
crv_50 = Curve(crv_8)
merge_16 = Merge(Data1=crv_50, Data2=crv_49)

# ----
# Site - 无檐口线的定位点
pln_19 = Plane(dispatch_29.ListB)

# ----
# Site - 有檐口线的定位点
pln_20 = Plane(dispatch_29.ListA)

incurves = PointInCurves(Point=pln_20, Curves=crv_49)  # -> Relationship, Index, Point
incurves_2 = PointInCurves(Point=pln_20, Curves=merge_16)  # -> Relationship, Index, Point
equals_4 = Equality(FirstNumber=incurves_2.Relationship, SecondNumber="2")  # -> Equality, Inequality
equals_5 = Equality(FirstNumber=incurves.Relationship, SecondNumber="0")  # -> Equality, Inequality
dispatch_30 = Dispatch(List=pln_20, DispatchPattern=equals_4.Equality)  # -> ListA, ListB
dispatch_31 = Dispatch(List=pln_20, DispatchPattern=equals_5.Inequality)  # -> ListA, ListB
pln_21 = Plane(dispatch_30.ListB)

# ----
# 檐口出特殊处理:
# 比如作为吊顶处理
# +车道处特殊处理
pln_22 = Plane(dispatch_30.ListA)

# ----
# 车道处特殊处理
pln_23 = Plane(dispatch_31.ListA)

# ----
# 1.1有檐口线
pln_24 = Plane(pln_21)

# ----
# 1.0无檐口线初筛
pln_25 = Plane(pln_19)

deplane_26 = DeconstructPlane(Plane=pln_25)  # -> Origin, XAxis, YAxis, ZAxis
crv_51 = Curve(filter_6)
incurves_3 = PointInCurves(Point=deplane_26.Origin, Curves=flatten(crv_51))  # -> Relationship, Index, Point
equals_6 = Equality(FirstNumber=incurves_3.Relationship, SecondNumber="2")  # -> Equality, Inequality
dispatch_32 = Dispatch(List=pln_25, DispatchPattern=equals_6.Equality)  # -> ListA, ListB
crv_52 = Curve(crv_50)
data_41 = Data(dispatch_32.ListB)

# ----
# 1.1.1布埋件
pln_26 = Plane(pln_24)

# ----
# 0.有檐口-整个site一起处理
deplane_27 = DeconstructPlane(Plane=pln_26)  # -> Origin, XAxis, YAxis, ZAxis
amp_21 = Amplitude(Vector=deplane_27.YAxis, Amplitude=number_slider_6)
move_30 = Move(Geometry=deplane_27.Origin, Motion=amp_21)  # -> Geometry, Transform
ln_45 = Line(StartPoint=deplane_27.Origin, EndPoint=move_30.Geometry)
ccx_19 = CurveCurve(CurveA=graft(ln_45), CurveB=flatten(merge_3))  # -> Points, ParamsA, ParamsB
shift = ShiftPaths(Data=ccx_19.Points, Offset=-1)
sort_21 = SortList(Keys=shift, ValuesA=shift)  # -> Keys, ValuesA
pull_28 = PullPoint(Point=sort_21.ValuesA, Geometry=graft(deplane_27.Origin), ClosestOnly=True)  # -> ClosestPoint, Distance
sort_22 = SortList(Keys=pull_28.Distance, ValuesA=sort_21.ValuesA)  # -> Keys, ValuesA
item_50 = ListItem(List=sort_22.ValuesA, Index="-1", Wrap=True)
null_6 = NullItem(Item=flatten(item_50))  # -> NullFlags, InvalidFlags, Description
dispatch_33 = Dispatch(List=item_50, DispatchPattern=item_50)  # -> ListA, ListB
dispatch_34 = Dispatch(List=pln_26, DispatchPattern=null_6.InvalidFlags)  # -> ListA, ListB
data_42 = Data(dispatch_33.ListA)
data_43 = Data(dispatch_34.ListB)
check_same_points_5 = CheckSamePoints(archPoint=pln_26, crvPoint=data_43)  # -> out, specialPt; inputs archPoint: list of Point3d, crvPoint: list of Point3d; same code as testpoint
deplane_28 = DeconstructPlane(Plane=data_43)  # -> Origin, XAxis, YAxis, ZAxis

pln_27 = Plane(dispatch_32.ListA)
incurves_4 = PointInCurves(Point=pln_27, Curves=flatten(crv_52))  # -> Relationship, Index, Point
equals_7 = Equality(FirstNumber=incurves_4.Relationship, SecondNumber="0")  # -> Equality, Inequality
dispatch_35 = Dispatch(List=pln_27, DispatchPattern=equals_7.Equality)  # -> ListA, ListB
pln_28 = Plane(dispatch_35.ListB)

# ----
# 1.0无檐口线
pln_29 = Plane(dispatch_35.ListA)

# ----
# 1.0无檐口线+上下层幕墙边线连续
crv_53 = Curve(crv_5)
pln_30 = Plane(pln_29)
crv_54 = Curve(crv)
deplane_29 = DeconstructPlane(Plane=pln_30)  # -> Origin, XAxis, YAxis, ZAxis
number_slider_26 = Slider(3584, range=0..10000)
amp_22 = Amplitude(Vector=deplane_29.YAxis, Amplitude=number_slider_26)
amp_23 = Amplitude(Vector=deplane_29.YAxis, Amplitude=expr("-x", number_slider_26))
move_31 = Move(Geometry=deplane_29.Origin, Motion=amp_22)  # -> Geometry, Transform
move_32 = Move(Geometry=deplane_29.Origin, Motion=amp_23)  # -> Geometry, Transform
ln_46 = Line(StartPoint=move_32.Geometry, EndPoint=move_31.Geometry)
ccx_20 = CurveCurve(CurveA=ln_46, CurveB=crv_54)  # -> flatten(Points), ParamsA, ParamsB
ccx_21 = CurveCurve(CurveA=ln_46, CurveB=crv_53)  # -> flatten(Points), ParamsA, ParamsB
pull_29 = PullPoint(Point=ccx_21.Points, Geometry=ccx_20.Points, ClosestOnly=True)  # -> ClosestPoint, Distance
sort_23 = SortList(Keys=pull_29.Distance, ValuesA=pull_29.ClosestPoint)  # -> Keys, ValuesA
pln_31 = Plane(pln_30)
panel_53 = Panel(sort_23.Keys)
larger_10 = LargerThan(FirstNumber=sort_23.Keys, SecondNumber=Slider(1.1, range=0..10))  # -> LargerThan, OrEqualTo
dispatch_36 = Dispatch(List=sort_23.ValuesA, DispatchPattern=larger_10.LargerThan)  # -> ListA, ListB
pt_32 = Point(dispatch_36.ListB)
pt_33 = Point(dispatch_36.ListA)
pull_30 = PullPoint(Point=deplane_29.Origin, Geometry=graft(pt_32), ClosestOnly=True)  # -> ClosestPoint, Distance
sort_24 = SortList(Keys=pull_30.Distance, ValuesA=pln_31)  # -> Keys, ValuesA
item_51 = ListItem(List=sort_24.ValuesA, Index=0, Wrap=True)
check_same_points_6 = CheckSamePoints(archPoint=pln_31, crvPoint=flatten(item_51))  # -> out, specialPt; inputs archPoint: list of Point3d, crvPoint: list of Point3d; same code as testpoint
item_52 = ListItem(List=pln_31, Index=check_same_points_6.specialPt, Wrap=True)
deplane_30 = DeconstructPlane(Plane=item_52)  # -> Origin, XAxis, YAxis, ZAxis
amp_24 = Amplitude(Vector=deplane_30.YAxis, Amplitude=expr("-x", Slider(2756, range=0..10000)))
crv_55 = Curve(merge_3)
move_33 = Move(Geometry=deplane_30.Origin, Motion=amp_24)  # -> Geometry, Transform
ln_47 = Line(StartPoint=deplane_30.Origin, EndPoint=move_33.Geometry)
ccx_22 = CurveCurve(CurveA=graft(ln_47), CurveB=flatten(crv_55))  # -> Points, ParamsA, ParamsB
shift_2 = ShiftPaths(Data=ccx_22.Points, Offset=-1)
pull_31 = PullPoint(Point=deplane_30.Origin, Geometry=shift_2, ClosestOnly=True)  # -> ClosestPoint, Distance
sort_25 = SortList(Keys=pull_31.Distance, ValuesA=pull_31.ClosestPoint)  # -> Keys, ValuesA
item_53 = ListItem(List=sort_25.ValuesA, Index=0, Wrap=True)
null_7 = NullItem(Item=flatten(item_53))  # -> NullFlags, InvalidFlags, Description
dispatch_37 = Dispatch(List=item_52, DispatchPattern=null_7.InvalidFlags)  # -> ListA, ListB
dispatch_38 = Dispatch(List=item_53, DispatchPattern=item_53)  # -> ListA, ListB
data_44 = Data(dispatch_37.ListB)
data_45 = Data(dispatch_38.ListA)
flatten_17 = FlattenTree(Tree=data_45, Path="{0}")
ln_48 = Line(StartPoint=data_44, EndPoint=flatten_17)
len_8 = Length(Curve=ln_48)
sort_26 = SortList(Keys=len_8)  # -> reverse(Keys), ValuesA
move2pt_16 = MoveToPoint(Geometry=data_44, PointA=data_44, PointB=flatten(data_45))  # -> Moved, Vector, Transform

# ----
# 0无檐口线
# 与梁不相交
cull_i_16 = CullIndex(List=pln_26, Indices=check_same_points_5.specialPt, Wrap=True)

# ----
# 0 檐口出定位点
# 与结构无交点
pln_32 = Plane(cull_i_16)

# ----
# 0.Missing Point
# 埋件定位点Offset，没有找到和梁的交点
number_slider_27 = Slider(5000, range=0..10000)
deplane_31 = DeconstructPlane(Plane=pln_32)  # -> Origin, XAxis, YAxis, ZAxis
amp_25 = Amplitude(Vector=deplane_31.YAxis, Amplitude=number_slider_27)
move_34 = Move(Geometry=deplane_31.Origin, Motion=amp_25)  # -> Geometry, Transform
ln_49 = Line(StartPoint=move_34.Geometry, EndPoint=deplane_31.Origin)
amp_26 = Amplitude(Vector=deplane_31.XAxis, Amplitude=number_slider_7)
amp_27 = Amplitude(Vector=deplane_31.XAxis, Amplitude=expr("-x", number_slider_7))
move_35 = Move(Geometry=ln_49, Motion=amp_26)  # -> Geometry, Transform
move_36 = Move(Geometry=ln_49, Motion=amp_27)  # -> Geometry, Transform

ccx_23 = CurveCurve(CurveA=graft(move_36.Geometry), CurveB=flatten(merge_3))  # -> Points, ParamsA, ParamsB
shift_3 = ShiftPaths(Data=ccx_23.Points, Offset=-1)
sort_27 = SortList(Keys=shift_3, ValuesA=shift_3)  # -> Keys, ValuesA
pull_32 = PullPoint(Point=sort_27.ValuesA, Geometry=graft(pln_32), ClosestOnly=True)  # -> ClosestPoint, Distance
sort_28 = SortList(Keys=pull_32.Distance, ValuesA=sort_27.ValuesA)  # -> Keys, ValuesA
item_54 = ListItem(List=sort_28.ValuesA, Index="-1", Wrap=True)
null_8 = NullItem(Item=flatten(item_54))  # -> NullFlags, InvalidFlags, Description
dispatch_39 = Dispatch(List=simplify(item_54), DispatchPattern=simplify(graft(null_8.InvalidFlags)))  # -> ListA, ListB
dispatch_40 = Dispatch(List=pln_32, DispatchPattern=null_8.InvalidFlags)  # -> ListA, ListB
pln_33 = Plane(dispatch_40.ListB)
pt_34 = Point(dispatch_39.ListB)

ccx_24 = CurveCurve(CurveA=graft(move_35.Geometry), CurveB=flatten(merge_3))  # -> Points, ParamsA, ParamsB
shift_4 = ShiftPaths(Data=ccx_24.Points, Offset=-1)
sort_29 = SortList(Keys=shift_4, ValuesA=shift_4)  # -> Keys, ValuesA
pull_33 = PullPoint(Point=sort_29.ValuesA, Geometry=graft(pln_32), ClosestOnly=True)  # -> ClosestPoint, Distance
sort_30 = SortList(Keys=pull_33.Distance, ValuesA=sort_29.ValuesA)  # -> Keys, ValuesA
item_55 = ListItem(List=sort_30.ValuesA, Index="-1", Wrap=True)
null_9 = NullItem(Item=flatten(item_55))  # -> NullFlags, InvalidFlags, Description
dispatch_41 = Dispatch(List=simplify(item_55), DispatchPattern=simplify(graft(null_9.InvalidFlags)))  # -> ListA, ListB
dispatch_42 = Dispatch(List=pln_32, DispatchPattern=null_9.InvalidFlags)  # -> ListA, ListB
pln_34 = Plane(dispatch_42.ListB)
pt_35 = Point(dispatch_41.ListB)

# ----
# 0.檐口处侧埋，钢板焊
# 02：钢板焊埋件[钢梁外侧]
# @钢边梁宽@钢边梁高
move2pt_17 = MoveToPoint(Geometry=data_43, PointA=deplane_28.Origin, PointB=flatten(data_42))  # -> Moved, Vector, Transform

# ----
# 0 檐口出特殊处理
# 比如作为吊顶处理
pln_35 = Plane(pln_22)
pt_36 = Point(pln_35)

# ----
# 撞到结构
move2pt_18 = MoveToPoint(Geometry=flatten(pln_33), PointA=flatten(pln_33), PointB=flatten(pt_34))  # -> Moved, Vector, Transform
move2pt_19 = MoveToPoint(Geometry=flatten(pln_34), PointA=flatten(pln_34), PointB=flatten(pt_35))  # -> Moved, Vector, Transform

# ----
# 1.0无檐口线
# 与梁不相交
# 与梁无交点的定位点
pln_36 = Plane(dispatch_37.ListA)

cull_i_17 = CullIndex(List=pln_31, Indices=check_same_points_6.specialPt, Wrap=True)
pln_37 = Plane(pln_24)
merge_17 = Merge(Data1=cull_i_17, Data2=pln_37)  # -> flatten(Result)

# ----
# 和下层楼板发生关系的定位点
pln_38 = Plane(pln_37)

pln_39 = Plane(pln_38)

number_slider_28 = Slider(3584, range=0..10000)
deplane_32 = DeconstructPlane(Plane=pln_39)  # -> Origin, XAxis, YAxis, ZAxis
amp_28 = Amplitude(Vector=deplane_32.YAxis, Amplitude=number_slider_28)
amp_29 = Amplitude(Vector=deplane_32.YAxis, Amplitude=expr("-x", number_slider_28))
boundary_3 = BoundarySurfaces(Edges=[offset_4, offset_5])
crv_56 = Curve(merge_2)
move_37 = Move(Geometry=deplane_32.Origin, Motion=amp_29)  # -> Geometry, Transform
move_38 = Move(Geometry=deplane_32.Origin, Motion=amp_28)  # -> Geometry, Transform
scx = SurfaceCurve(Surface=boundary_3, Curve=crv_56)  # -> flatten(Curves), Points, UVPoints, Normals, Parameters, Tangents
ln_50 = Line(StartPoint=move_37.Geometry, EndPoint=move_38.Geometry)
ccx_25 = CurveCurve(CurveA=graft(ln_50), CurveB=scx.Curves)  # -> Points, ParamsA, ParamsB
shift_5 = ShiftPaths(Data=ccx_25.Points, Offset=-1)
pull_34 = PullPoint(Point=graft(pln_39), Geometry=shift_5, ClosestOnly=True)  # -> ClosestPoint, Distance
sort_31 = SortList(Keys=pull_34.Distance, ValuesA=pull_34.ClosestPoint)  # -> Keys, ValuesA
null_10 = NullItem(Item=sort_31.ValuesA)  # -> NullFlags, simplify(InvalidFlags), Description
dispatch_43 = Dispatch(List=simplify(graft(pln_39)), DispatchPattern=null_10.InvalidFlags)  # -> ListA, ListB
item_56 = ListItem(List=sort_31.ValuesA, Index=0, Wrap=True)
pln_40 = Plane(dispatch_43.ListA)
pln_41 = Plane(dispatch_43.ListB)

pln_42 = Plane(pln_39)
number_slider_29 = Slider(3584, range=0..10000)
deplane_33 = DeconstructPlane(Plane=pln_42)  # -> Origin, XAxis, YAxis, ZAxis
crv_57 = Curve(merge_3)
boundary_4 = BoundarySurfaces(Edges=[offset_3, offset_2])
scx_2 = SurfaceCurve(Surface=boundary_4, Curve=crv_57)  # -> flatten(Curves), Points, UVPoints, Normals, Parameters, Tangents
amp_30 = Amplitude(Vector=deplane_33.YAxis, Amplitude=number_slider_29)
amp_31 = Amplitude(Vector=deplane_33.YAxis, Amplitude=expr("-x", number_slider_29))
move_39 = Move(Geometry=deplane_33.Origin, Motion=amp_31)  # -> Geometry, Transform
move_40 = Move(Geometry=deplane_33.Origin, Motion=amp_30)  # -> Geometry, Transform
ln_51 = Line(StartPoint=move_39.Geometry, EndPoint=move_40.Geometry)
ccx_26 = CurveCurve(CurveA=graft(ln_51), CurveB=scx_2.Curves)  # -> Points, ParamsA, ParamsB
shift_6 = ShiftPaths(Data=ccx_26.Points, Offset=-1)
pull_35 = PullPoint(Point=graft(pln_42), Geometry=shift_6, ClosestOnly=True)  # -> ClosestPoint, Distance
sort_32 = SortList(Keys=pull_35.Distance, ValuesA=pull_35.ClosestPoint)  # -> Keys, ValuesA
null_11 = NullItem(Item=sort_32.ValuesA)  # -> NullFlags, simplify(InvalidFlags), Description
dispatch_44 = Dispatch(List=simplify(graft(pln_42)), DispatchPattern=null_11.InvalidFlags)  # -> ListA, ListB
item_57 = ListItem(List=sort_32.ValuesA, Index=0, Wrap=True)
pln_43 = Plane(dispatch_44.ListB)
pln_44 = Plane(dispatch_44.ListA)

# ----
# 可能的结构交点-大量
pln_45 = Plane(pln_44)

# ----
# 可能的结构交点-大量
pln_46 = Plane(pln_40)

# ----
# 0 檐口出定位点
# 与结构无交点
pln_47 = Plane(flatten(pln_46))

# ----
# 0 檐口出定位点
# 与结构无交点
pln_48 = Plane(flatten(pln_45))

# ----
# 1.2.3
# 下层建筑边线内侧300-600mm范围
# 03：钢板焊埋件[钢梁外侧]
# @钢边梁宽@钢边梁高
move2pt_20 = MoveToPoint(Geometry=pln_43, PointA=pln_43, PointB=simplify(item_57))  # -> Moved, Vector, Transform

# ----
# 1.2.2
# 下层建筑边线外侧50-350mm
# 03：钢板焊埋件[钢梁内侧]
# @钢边梁宽@钢边梁高
move2pt_21 = MoveToPoint(Geometry=pln_41, PointA=pln_41, PointB=item_56)  # -> Moved, Vector, Transform

# ----
# 3.3上层建筑边线,
# 默认建筑提供上翻，如主结构提供示意则使用结构定位【该项目无】，
# 如无则使用建筑边线向内50mm作为埋件定位
merge_18 = Merge(Data1=pln_23, Data2=pln_39)
crv_58 = Curve(crv)
offset_14 = OffsetCurve(Curve=crv_58, Distance=expr("-x", Slider(50, range=0..100)), Corners=1)
pln_49 = Plane(merge_18)
number_slider_30 = Slider(3584, range=0..10000)
deplane_34 = DeconstructPlane(Plane=pln_49)  # -> Origin, XAxis, YAxis, ZAxis
amp_32 = Amplitude(Vector=deplane_34.YAxis, Amplitude=number_slider_30)
amp_33 = Amplitude(Vector=deplane_34.YAxis, Amplitude=expr("-x", number_slider_30))
move_41 = Move(Geometry=deplane_34.Origin, Motion=amp_33)  # -> Geometry, Transform
move_42 = Move(Geometry=deplane_34.Origin, Motion=amp_32)  # -> Geometry, Transform
ln_52 = Line(StartPoint=move_41.Geometry, EndPoint=move_42.Geometry)
ccx_27 = CurveCurve(CurveA=ln_52, CurveB=offset_14)  # -> simplify(Points), ParamsA, ParamsB
ln_53 = Line(StartPoint=ccx_27.Points, EndPoint=simplify(graft(pln_49)))
len_9 = Length(Curve=ln_53)
null_12 = NullItem(Item=ccx_27.Points)  # -> NullFlags, InvalidFlags, Description
sort_33 = SortList(Keys=len_9, ValuesA=simplify(ccx_27.Points))  # -> Keys, ValuesA
dispatch_45 = Dispatch(List=simplify(graft(pln_49)), DispatchPattern=null_12.NullFlags)  # -> ListA, ListB
item_58 = ListItem(List=sort_33.ValuesA, Index=0, Wrap=True)

# ----
# 可能的双点
pln_50 = Plane(dispatch_45.ListA)

# ----
# 0 檐口出定位点
# 与结构无交点
pln_51 = Plane(flatten(pln_50))

# ----
# 3.3上层建筑边线,
# 默认建筑提供上翻
# 04：板埋埋件[混凝土楼板上侧]
# @板埋参数xn
move2pt_22 = MoveToPoint(Geometry=simplify(graft(pln_49)), PointA=simplify(graft(pln_49)), PointB=item_58)  # -> Moved, Vector, Transform

number = NumberGroups(Number=sort_26.Keys, Difference=Slider(50, range=0..100))  # -> simplify(Groups), Indices
panel_54 = Panel(number.Groups)
tstat = TreeStatistics(Tree=number.Groups)  # -> Paths, Length, Count
lng_6 = ListLength(List=tstat.Paths)
smaller_9 = SmallerThan(FirstNumber=lng_6, SecondNumber="2")  # -> SmallerThan, OrEqualTo
dispatch_46 = Dispatch(List=smaller_9.OrEqualTo, DispatchPattern=[True, False])  # -> ListA, ListB
filter_30 = StreamFilter(Gate=dispatch_46.ListA, Stream0="-2", Stream1="-1")
item_59 = ListItem(List=tstat.Paths, Index=filter_30, Wrap=True)
branch = TreeBranch(Tree=number.Groups, Path=item_59, MaintainPaths=True)
sort_34 = SortList(Keys=branch)  # -> reverse(Keys), ValuesA
round_2 = Round(Number=sort_34.Keys)  # -> Nearest, Floor, Ceiling
item_60 = ListItem(List=round_2.Ceiling, Index=0, Wrap=True)

list_12 = ValueList({"自己输入Value": 0, "GH Defaut Value": 1}, selected="GH Defaut Value")
panel_55 = Panel(item_60)
filter_31 = StreamFilter(Gate=list_12, Stream0=Slider(1000, range=0..10000), Stream1=panel_55)

larger_11 = LargerThan(FirstNumber=len_8, SecondNumber=filter_31)  # -> LargerThan, OrEqualTo
dispatch_47 = Dispatch(List=flatten_17, DispatchPattern=larger_11.LargerThan)  # -> ListA, ListB
dispatch_48 = Dispatch(List=data_44, DispatchPattern=larger_11.LargerThan)  # -> ListA, ListB
data_46 = Data(dispatch_48.ListB)
data_47 = Data(dispatch_47.ListB)
move2pt_23 = MoveToPoint(Geometry=data_46, PointA=data_46, PointB=flatten(data_47))  # -> Moved, Vector, Transform

# ----
# 离梁过远的定位点
pln_52 = Plane(dispatch_48.ListA)

merge_19 = Merge(Data1=pln_36, Data2=pln_52)

# ----
# 0 檐口出定位点
# 与结构无交点
pln_53 = Plane(flatten(merge_19))

# ----
# 0.Missing Point
# 埋件定位点Offset，没有找到和梁的交点
number_slider_31 = Slider(5000, range=0..10000)
deplane_35 = DeconstructPlane(Plane=pln_53)  # -> Origin, XAxis, YAxis, ZAxis
amp_34 = Amplitude(Vector=deplane_35.YAxis, Amplitude=number_slider_31)
move_43 = Move(Geometry=deplane_35.Origin, Motion=amp_34)  # -> Geometry, Transform
ln_54 = Line(StartPoint=move_43.Geometry, EndPoint=deplane_35.Origin)
crv_59 = Curve(crv_55)
amp_35 = Amplitude(Vector=deplane_35.XAxis, Amplitude=number_slider_7)
amp_36 = Amplitude(Vector=deplane_35.XAxis, Amplitude=expr("-x", number_slider_7))
move_44 = Move(Geometry=ln_54, Motion=amp_35)  # -> Geometry, Transform
move_45 = Move(Geometry=ln_54, Motion=amp_36)  # -> Geometry, Transform

ccx_28 = CurveCurve(CurveA=graft(move_45.Geometry), CurveB=flatten(crv_59))  # -> Points, ParamsA, ParamsB
shift_7 = ShiftPaths(Data=ccx_28.Points, Offset=-1)
sort_35 = SortList(Keys=shift_7, ValuesA=shift_7)  # -> Keys, ValuesA
pull_36 = PullPoint(Point=sort_35.ValuesA, Geometry=graft(pln_53), ClosestOnly=True)  # -> ClosestPoint, Distance
sort_36 = SortList(Keys=pull_36.Distance, ValuesA=sort_35.ValuesA)  # -> Keys, ValuesA
item_61 = ListItem(List=sort_36.ValuesA, Index="-1", Wrap=True)
null_13 = NullItem(Item=flatten(item_61))  # -> NullFlags, InvalidFlags, Description
dispatch_49 = Dispatch(List=simplify(item_61), DispatchPattern=simplify(graft(null_13.InvalidFlags)))  # -> ListA, ListB
dispatch_50 = Dispatch(List=pln_53, DispatchPattern=null_13.InvalidFlags)  # -> ListA, ListB
pln_54 = Plane(dispatch_50.ListB)
pt_37 = Point(dispatch_49.ListB)

ccx_29 = CurveCurve(CurveA=graft(move_44.Geometry), CurveB=flatten(crv_59))  # -> Points, ParamsA, ParamsB
shift_8 = ShiftPaths(Data=ccx_29.Points, Offset=-1)
sort_37 = SortList(Keys=shift_8, ValuesA=shift_8)  # -> Keys, ValuesA
pull_37 = PullPoint(Point=sort_37.ValuesA, Geometry=graft(pln_53), ClosestOnly=True)  # -> ClosestPoint, Distance
sort_38 = SortList(Keys=pull_37.Distance, ValuesA=sort_37.ValuesA)  # -> Keys, ValuesA
item_62 = ListItem(List=sort_38.ValuesA, Index="-1", Wrap=True)
null_14 = NullItem(Item=flatten(item_62))  # -> NullFlags, InvalidFlags, Description
dispatch_51 = Dispatch(List=simplify(item_62), DispatchPattern=simplify(graft(null_14.InvalidFlags)))  # -> ListA, ListB
dispatch_52 = Dispatch(List=pln_53, DispatchPattern=null_14.InvalidFlags)  # -> ListA, ListB
pln_55 = Plane(dispatch_52.ListB)
pt_38 = Point(dispatch_51.ListB)

# ----
# 撞到结构
move2pt_24 = MoveToPoint(Geometry=flatten(pln_55), PointA=flatten(pln_55), PointB=flatten(pt_38))  # -> Moved, Vector, Transform
move2pt_25 = MoveToPoint(Geometry=flatten(pln_54), PointA=flatten(pln_54), PointB=flatten(pt_37))  # -> Moved, Vector, Transform

# ----
# 撞到结构
merge_20 = Merge(Data1=move2pt_24.Moved, Data2=move2pt_25.Moved)

# ----
# 单定位点
filter_32 = StreamFilter(Gate=list_10, Stream0=move2pt_23.Moved, Stream1=move2pt_16.Moved)

# ----
# 1.2是否有吊顶
deplane_36 = DeconstructPlane(Plane=pln_38)  # -> Origin, XAxis, YAxis, ZAxis
number_slider_32 = Slider(5000, range=0..10000)
amp_37 = Amplitude(Vector=deplane_36.YAxis, Amplitude=expr("-x", number_slider_32))
amp_38 = Amplitude(Vector=deplane_36.YAxis, Amplitude=number_slider_32)
move_46 = Move(Geometry=deplane_36.Origin, Motion=amp_38)  # -> Geometry, Transform
move_47 = Move(Geometry=deplane_36.Origin, Motion=amp_37)  # -> Geometry, Transform
ln_55 = Line(StartPoint=move_46.Geometry, EndPoint=move_47.Geometry)
crv_60 = Curve(crv_5)
ccx_30 = CurveCurve(CurveA=ln_55, CurveB=crv_60)  # -> Points, ParamsA, ParamsB
null_15 = NullItem(Item=ccx_30.Points)  # -> NullFlags, InvalidFlags, Description
dispatch_53 = Dispatch(List=simplify(graft(pln_38)), DispatchPattern=simplify(null_15.NullFlags))  # -> ListA, ListB
pln_56 = Plane(flatten(dispatch_53.ListB))
flatten_18 = FlattenTree(Tree=ccx_30.Points, Path="{0}")
ln_56 = Line(StartPoint=pln_56, EndPoint=flatten_18)
crv_61 = Curve(merge_2)

# ----
# 定位点Project到下层建筑线
move2pt_26 = MoveToPoint(Geometry=pln_56, PointA=pln_56, PointB=flatten_18)  # -> Moved, Vector, Transform

deplane_37 = DeconstructPlane(Plane=move2pt_26.Moved)  # -> Origin, XAxis, YAxis, ZAxis
amp_39 = Amplitude(Vector=deplane_37.YAxis, Amplitude=Slider(5000, range=0..10000))
move_48 = Move(Geometry=deplane_37.Origin, Motion=amp_39)  # -> Geometry, Transform
ln_57 = Line(StartPoint=move_48.Geometry, EndPoint=deplane_37.Origin)
ccx_31 = CurveCurve(CurveA=graft(ln_57), CurveB=flatten(crv_61))  # -> simplify(Points), ParamsA, ParamsB
shift_9 = ShiftPaths(Data=ccx_31.Points, Offset=-1)
null_16 = NullItem(Item=shift_9)  # -> NullFlags, InvalidFlags, Description
dispatch_54 = Dispatch(List=simplify(graft(move2pt_26.Moved)), DispatchPattern=null_16.NullFlags)  # -> ListA, ListB
dispatch_55 = Dispatch(List=simplify(graft(ln_57)), DispatchPattern=null_16.NullFlags)  # -> ListA, ListB
pln_57 = Plane(dispatch_54.ListA)
crv_62 = Curve(dispatch_55.ListB)
pln_58 = Plane(dispatch_54.ListB)
ccx_32 = CurveCurve(CurveA=graft(crv_62), CurveB=flatten(crv_61))  # -> Points, ParamsA, ParamsB
shift_10 = ShiftPaths(Data=simplify(ccx_32.Points), Offset=-1)
pull_38 = PullPoint(Point=pln_58, Geometry=shift_10, ClosestOnly=True)  # -> ClosestPoint, Distance
sort_39 = SortList(Keys=pull_38.Distance, ValuesA=pull_38.ClosestPoint)  # -> Keys, ValuesA
item_63 = ListItem(List=sort_39.ValuesA, Index=0, Wrap=True)
ln_58 = Line(StartPoint=pln_58, EndPoint=item_63)
len_10 = Length(Curve=ln_58)
panel_56 = Panel(len_10)
larger_12 = LargerThan(FirstNumber=len_10, SecondNumber=number_slider_8)  # -> LargerThan, OrEqualTo
dispatch_56 = Dispatch(List=pln_58, DispatchPattern=larger_12.LargerThan)  # -> ListA, ListB
pln_59 = Plane(dispatch_56.ListB)
pln_60 = Plane(dispatch_56.ListA)

# ----
# 可能的点-离结构很远
pln_61 = Plane(dispatch_53.ListA)

# ----
# 可能的结构交点-大量
pln_62 = Plane(pln_57)

# ----
# 可能的结构交点
pln_63 = Plane(pln_59)

merge_21 = Merge(Data1=pln_61, Data2=pln_63, Data3=pln_62)

# ----
# 0 檐口出定位点
# 与结构无交点
pln_64 = Plane(flatten(merge_21))

# ----
# 1.2 Missing Point
# 埋件定位点Offset，没有找到和梁的交点
number_slider_33 = Slider(5000, range=0..10000)
deplane_38 = DeconstructPlane(Plane=pln_64)  # -> Origin, XAxis, YAxis, ZAxis
amp_40 = Amplitude(Vector=deplane_38.YAxis, Amplitude=number_slider_33)
crv_63 = Curve(crv_61)
move_49 = Move(Geometry=deplane_38.Origin, Motion=amp_40)  # -> Geometry, Transform
ln_59 = Line(StartPoint=move_49.Geometry, EndPoint=deplane_38.Origin)
amp_41 = Amplitude(Vector=deplane_38.XAxis, Amplitude=number_slider_7)
amp_42 = Amplitude(Vector=deplane_38.XAxis, Amplitude=expr("-x", number_slider_7))
move_50 = Move(Geometry=ln_59, Motion=amp_41)  # -> Geometry, Transform
move_51 = Move(Geometry=ln_59, Motion=amp_42)  # -> Geometry, Transform

ccx_33 = CurveCurve(CurveA=graft(move_51.Geometry), CurveB=flatten(crv_63))  # -> Points, ParamsA, ParamsB
shift_11 = ShiftPaths(Data=ccx_33.Points, Offset=-1)
sort_40 = SortList(Keys=shift_11, ValuesA=shift_11)  # -> Keys, ValuesA
pull_39 = PullPoint(Point=sort_40.ValuesA, Geometry=graft(pln_64), ClosestOnly=True)  # -> ClosestPoint, Distance
sort_41 = SortList(Keys=pull_39.Distance, ValuesA=sort_40.ValuesA)  # -> Keys, ValuesA
item_64 = ListItem(List=sort_41.ValuesA, Index="-1", Wrap=True)
null_17 = NullItem(Item=flatten(item_64))  # -> NullFlags, InvalidFlags, Description
dispatch_57 = Dispatch(List=simplify(item_64), DispatchPattern=simplify(graft(null_17.InvalidFlags)))  # -> ListA, ListB
dispatch_58 = Dispatch(List=pln_64, DispatchPattern=null_17.InvalidFlags)  # -> ListA, ListB
pln_65 = Plane(dispatch_58.ListB)
pt_39 = Point(dispatch_57.ListB)

ccx_34 = CurveCurve(CurveA=graft(move_50.Geometry), CurveB=flatten(crv_63))  # -> Points, ParamsA, ParamsB
shift_12 = ShiftPaths(Data=ccx_34.Points, Offset=-1)
sort_42 = SortList(Keys=shift_12, ValuesA=shift_12)  # -> Keys, ValuesA
pull_40 = PullPoint(Point=sort_42.ValuesA, Geometry=graft(pln_64), ClosestOnly=True)  # -> ClosestPoint, Distance
sort_43 = SortList(Keys=pull_40.Distance, ValuesA=sort_42.ValuesA)  # -> Keys, ValuesA
item_65 = ListItem(List=sort_43.ValuesA, Index="-1", Wrap=True)
null_18 = NullItem(Item=flatten(item_65))  # -> NullFlags, InvalidFlags, Description
dispatch_59 = Dispatch(List=simplify(item_65), DispatchPattern=simplify(graft(null_18.InvalidFlags)))  # -> ListA, ListB
dispatch_60 = Dispatch(List=pln_64, DispatchPattern=null_18.InvalidFlags)  # -> ListA, ListB
pln_66 = Plane(dispatch_60.ListB)
pt_40 = Point(dispatch_59.ListB)

# ----
# 撞到结构
move2pt_27 = MoveToPoint(Geometry=flatten(pln_66), PointA=flatten(pln_66), PointB=flatten(pt_40))  # -> Moved, Vector, Transform
move2pt_28 = MoveToPoint(Geometry=flatten(pln_65), PointA=flatten(pln_65), PointB=flatten(pt_39))  # -> Moved, Vector, Transform

# ----
# 1.2.1梁以内>350
# 
# 侧埋，钢板焊
# 03：钢板焊埋件[钢梁内侧]
# @钢边梁宽@钢边梁高
move2pt_29 = MoveToPoint(Geometry=pln_60, PointA=pln_60, PointB=item_63)  # -> Moved, Vector, Transform

# ----
# 撞到结构
merge_22 = Merge(Data1=move2pt_27.Moved, Data2=move2pt_28.Moved)

# ----
# 2.1 Missing Point
# 埋件定位点Offset，没有找到和梁的交点
number_slider_34 = Slider(5000, range=0..10000)
deplane_39 = DeconstructPlane(Plane=pln_47)  # -> Origin, XAxis, YAxis, ZAxis
amp_43 = Amplitude(Vector=deplane_39.YAxis, Amplitude=number_slider_34)
crv_64 = Curve(scx.Curves)
move_52 = Move(Geometry=deplane_39.Origin, Motion=amp_43)  # -> Geometry, Transform
ln_60 = Line(StartPoint=move_52.Geometry, EndPoint=deplane_39.Origin)
amp_44 = Amplitude(Vector=deplane_39.XAxis, Amplitude=number_slider_7)
amp_45 = Amplitude(Vector=deplane_39.XAxis, Amplitude=expr("-x", number_slider_7))
move_53 = Move(Geometry=ln_60, Motion=amp_44)  # -> Geometry, Transform
move_54 = Move(Geometry=ln_60, Motion=amp_45)  # -> Geometry, Transform
pln_67 = Plane(pln_40)

ccx_35 = CurveCurve(CurveA=graft(move_54.Geometry), CurveB=flatten(crv_64))  # -> Points, ParamsA, ParamsB
shift_13 = ShiftPaths(Data=ccx_35.Points, Offset=-1)
sort_44 = SortList(Keys=shift_13, ValuesA=shift_13)  # -> Keys, ValuesA
pull_41 = PullPoint(Point=sort_44.ValuesA, Geometry=graft(pln_47), ClosestOnly=True)  # -> ClosestPoint, Distance
sort_45 = SortList(Keys=pull_41.Distance, ValuesA=sort_44.ValuesA)  # -> Keys, ValuesA
item_66 = ListItem(List=sort_45.ValuesA, Index="-1", Wrap=True)
null_19 = NullItem(Item=flatten(item_66))  # -> NullFlags, InvalidFlags, Description
dispatch_61 = Dispatch(List=simplify(item_66), DispatchPattern=simplify(graft(null_19.InvalidFlags)))  # -> ListA, ListB
dispatch_62 = Dispatch(List=pln_47, DispatchPattern=null_19.InvalidFlags)  # -> ListA, ListB
pt_41 = Point(dispatch_61.ListB)
pln_68 = Plane(dispatch_62.ListB)

ccx_36 = CurveCurve(CurveA=graft(move_53.Geometry), CurveB=flatten(crv_64))  # -> Points, ParamsA, ParamsB
shift_14 = ShiftPaths(Data=ccx_36.Points, Offset=-1)
sort_46 = SortList(Keys=shift_14, ValuesA=shift_14)  # -> Keys, ValuesA
pull_42 = PullPoint(Point=sort_46.ValuesA, Geometry=graft(pln_47), ClosestOnly=True)  # -> ClosestPoint, Distance
sort_47 = SortList(Keys=pull_42.Distance, ValuesA=sort_46.ValuesA)  # -> Keys, ValuesA
item_67 = ListItem(List=sort_47.ValuesA, Index="-1", Wrap=True)
null_20 = NullItem(Item=flatten(item_67))  # -> NullFlags, InvalidFlags, Description
dispatch_63 = Dispatch(List=simplify(item_67), DispatchPattern=simplify(graft(null_20.InvalidFlags)))  # -> ListA, ListB
dispatch_64 = Dispatch(List=pln_47, DispatchPattern=null_20.InvalidFlags)  # -> ListA, ListB
pln_69 = Plane(dispatch_64.ListB)
pt_42 = Point(dispatch_63.ListB)

merge_23 = Merge(Data1=pln_69, Data2=pln_68)  # -> flatten(Result)
check_same_points_7 = CheckSamePoints(archPoint=flatten(pln_67), crvPoint=merge_23)  # -> out, specialPt; inputs archPoint: list of Point3d, crvPoint: list of Point3d; same code as testpoint

# ----
# 撞到结构
move2pt_30 = MoveToPoint(Geometry=flatten(pln_69), PointA=flatten(pln_69), PointB=flatten(pt_42))  # -> Moved, Vector, Transform
move2pt_31 = MoveToPoint(Geometry=flatten(pln_68), PointA=flatten(pln_68), PointB=flatten(pt_41))  # -> Moved, Vector, Transform

# ----
# pass
cull_i_18 = CullIndex(List=flatten(pln_67), Indices=check_same_points_7.specialPt, Wrap=True)

# ----
# 撞到结构
merge_24 = Merge(Data1=move2pt_30.Moved, Data2=move2pt_31.Moved)  # -> flatten(Result)

# ----
# 2.2  Missing Point
# 埋件定位点Offset，没有找到和梁的交点
number_slider_35 = Slider(5000, range=0..10000)
crv_65 = Curve(scx_2.Curves)
deplane_40 = DeconstructPlane(Plane=pln_48)  # -> Origin, XAxis, YAxis, ZAxis
amp_46 = Amplitude(Vector=deplane_40.YAxis, Amplitude=number_slider_35)
move_55 = Move(Geometry=deplane_40.Origin, Motion=amp_46)  # -> Geometry, Transform
ln_61 = Line(StartPoint=move_55.Geometry, EndPoint=deplane_40.Origin)
amp_47 = Amplitude(Vector=deplane_40.XAxis, Amplitude=number_slider_7)
amp_48 = Amplitude(Vector=deplane_40.XAxis, Amplitude=expr("-x", number_slider_7))
move_56 = Move(Geometry=ln_61, Motion=amp_47)  # -> Geometry, Transform
move_57 = Move(Geometry=ln_61, Motion=amp_48)  # -> Geometry, Transform
pln_70 = Plane(pln_44)

ccx_37 = CurveCurve(CurveA=graft(move_57.Geometry), CurveB=flatten(crv_65))  # -> Points, ParamsA, ParamsB
shift_15 = ShiftPaths(Data=ccx_37.Points, Offset=-1)
sort_48 = SortList(Keys=shift_15, ValuesA=shift_15)  # -> Keys, ValuesA
pull_43 = PullPoint(Point=sort_48.ValuesA, Geometry=graft(pln_48), ClosestOnly=True)  # -> ClosestPoint, Distance
sort_49 = SortList(Keys=pull_43.Distance, ValuesA=sort_48.ValuesA)  # -> Keys, ValuesA
item_68 = ListItem(List=sort_49.ValuesA, Index="-1", Wrap=True)
null_21 = NullItem(Item=flatten(item_68))  # -> NullFlags, InvalidFlags, Description
dispatch_65 = Dispatch(List=simplify(item_68), DispatchPattern=simplify(graft(null_21.InvalidFlags)))  # -> ListA, ListB
dispatch_66 = Dispatch(List=pln_48, DispatchPattern=null_21.InvalidFlags)  # -> ListA, ListB
pt_43 = Point(dispatch_65.ListB)
pln_71 = Plane(dispatch_66.ListB)

ccx_38 = CurveCurve(CurveA=graft(move_56.Geometry), CurveB=flatten(crv_65))  # -> Points, ParamsA, ParamsB
shift_16 = ShiftPaths(Data=ccx_38.Points, Offset=-1)
sort_50 = SortList(Keys=shift_16, ValuesA=shift_16)  # -> Keys, ValuesA
pull_44 = PullPoint(Point=sort_50.ValuesA, Geometry=graft(pln_48), ClosestOnly=True)  # -> ClosestPoint, Distance
sort_51 = SortList(Keys=pull_44.Distance, ValuesA=sort_50.ValuesA)  # -> Keys, ValuesA
item_69 = ListItem(List=sort_51.ValuesA, Index="-1", Wrap=True)
null_22 = NullItem(Item=flatten(item_69))  # -> NullFlags, InvalidFlags, Description
dispatch_67 = Dispatch(List=simplify(item_69), DispatchPattern=simplify(graft(null_22.InvalidFlags)))  # -> ListA, ListB
dispatch_68 = Dispatch(List=pln_48, DispatchPattern=null_22.InvalidFlags)  # -> ListA, ListB
pln_72 = Plane(dispatch_68.ListB)
pt_44 = Point(dispatch_67.ListB)

merge_25 = Merge(Data1=pln_72, Data2=pln_71)  # -> flatten(Result)
check_same_points_8 = CheckSamePoints(archPoint=flatten(pln_70), crvPoint=merge_25)  # -> out, specialPt; inputs archPoint: list of Point3d, crvPoint: list of Point3d; same code as testpoint

# ----
# 撞到结构
move2pt_32 = MoveToPoint(Geometry=flatten(pln_72), PointA=flatten(pln_72), PointB=flatten(pt_44))  # -> Moved, Vector, Transform
move2pt_33 = MoveToPoint(Geometry=flatten(pln_71), PointA=flatten(pln_71), PointB=flatten(pt_43))  # -> Moved, Vector, Transform

# ----
# pass
cull_i_19 = CullIndex(List=flatten(pln_70), Indices=check_same_points_8.specialPt, Wrap=True)

# ----
# 定位点中可能遗漏
# 上一层筛选中
# 和结构交叉出的点
pln_73 = Plane(cull_i_18)
pln_74 = Plane(cull_i_19)

# ----
# 3.1下层建筑内侧到300到外侧50内是否有钢结构
deplane_41 = DeconstructPlane(Plane=pln_73)  # -> Origin, XAxis, YAxis, ZAxis
deplane_42 = DeconstructPlane(Plane=pln_74)  # -> Origin, XAxis, YAxis, ZAxis
check_same_points_9 = CheckSamePoints(archPoint=deplane_42.Origin, crvPoint=deplane_41.Origin)  # -> out, specialPt; inputs archPoint: list of Point3d, crvPoint: list of Point3d; same code as testpoint

# ----
# 撞到结构
merge_26 = Merge(Data1=move2pt_32.Moved, Data2=move2pt_33.Moved)  # -> flatten(Result)

# ----
# 同时满足N
item_70 = ListItem(List=pln_74, Index=check_same_points_9.specialPt, Wrap=True)

pln_75 = Plane(item_70)
number_slider_36 = Slider(3584, range=0..10000)
deplane_43 = DeconstructPlane(Plane=pln_75)  # -> Origin, XAxis, YAxis, ZAxis
boundary_5 = BoundarySurfaces(Edges=[offset_7, offset_6])
crv_66 = Curve(crv_4)
amp_49 = Amplitude(Vector=deplane_43.YAxis, Amplitude=number_slider_36)
amp_50 = Amplitude(Vector=deplane_43.YAxis, Amplitude=expr("-x", number_slider_36))
scx_3 = SurfaceCurve(Surface=boundary_5, Curve=crv_66)  # -> flatten(Curves), Points, UVPoints, Normals, Parameters, Tangents
move_58 = Move(Geometry=deplane_43.Origin, Motion=amp_50)  # -> Geometry, Transform
move_59 = Move(Geometry=deplane_43.Origin, Motion=amp_49)  # -> Geometry, Transform
ln_62 = Line(StartPoint=move_58.Geometry, EndPoint=move_59.Geometry)
ccx_39 = CurveCurve(CurveA=graft(ln_62), CurveB=scx_3.Curves)  # -> Points, ParamsA, ParamsB
shift_17 = ShiftPaths(Data=ccx_39.Points, Offset=-1)
pull_45 = PullPoint(Point=graft(pln_75), Geometry=shift_17, ClosestOnly=True)  # -> ClosestPoint, Distance
sort_52 = SortList(Keys=pull_45.Distance, ValuesA=pull_45.ClosestPoint)  # -> Keys, ValuesA
null_23 = NullItem(Item=sort_52.ValuesA)  # -> NullFlags, simplify(InvalidFlags), Description
dispatch_69 = Dispatch(List=simplify(graft(pln_75)), DispatchPattern=null_23.InvalidFlags)  # -> ListA, ListB
item_71 = ListItem(List=sort_52.ValuesA, Index=0, Wrap=True)
pln_76 = Plane(dispatch_69.ListB)
pln_77 = Plane(dispatch_69.ListA)

# ----
# 可能的结构交点-大量
pln_78 = Plane(pln_77)

# ----
# 0 檐口出定位点
# 与结构无交点
pln_79 = Plane(flatten(pln_78))

# ----
# 3.1下层建筑内侧到300到外侧50内
# 底埋，钢板焊
move2pt_34 = MoveToPoint(Geometry=pln_76, PointA=pln_76, PointB=item_71)  # -> Moved, Vector, Transform

# ----
# 2.2  Missing Point
# 埋件定位点Offset，没有找到和梁的交点
number_slider_37 = Slider(5000, range=0..10000)
crv_67 = Curve(scx_3.Curves)
deplane_44 = DeconstructPlane(Plane=pln_79)  # -> Origin, XAxis, YAxis, ZAxis
amp_51 = Amplitude(Vector=deplane_44.YAxis, Amplitude=number_slider_37)
move_60 = Move(Geometry=deplane_44.Origin, Motion=amp_51)  # -> Geometry, Transform
ln_63 = Line(StartPoint=move_60.Geometry, EndPoint=deplane_44.Origin)
amp_52 = Amplitude(Vector=deplane_44.XAxis, Amplitude=number_slider_7)
amp_53 = Amplitude(Vector=deplane_44.XAxis, Amplitude=expr("-x", number_slider_7))
move_61 = Move(Geometry=ln_63, Motion=amp_52)  # -> Geometry, Transform
move_62 = Move(Geometry=ln_63, Motion=amp_53)  # -> Geometry, Transform
pln_80 = Plane(pln_79)

ccx_40 = CurveCurve(CurveA=graft(move_62.Geometry), CurveB=flatten(crv_67))  # -> Points, ParamsA, ParamsB
shift_18 = ShiftPaths(Data=ccx_40.Points, Offset=-1)
sort_53 = SortList(Keys=shift_18, ValuesA=shift_18)  # -> Keys, ValuesA
pull_46 = PullPoint(Point=sort_53.ValuesA, Geometry=graft(pln_79), ClosestOnly=True)  # -> ClosestPoint, Distance
sort_54 = SortList(Keys=pull_46.Distance, ValuesA=sort_53.ValuesA)  # -> Keys, ValuesA
item_72 = ListItem(List=sort_54.ValuesA, Index="-1", Wrap=True)
null_24 = NullItem(Item=flatten(item_72))  # -> NullFlags, InvalidFlags, Description
dispatch_70 = Dispatch(List=simplify(item_72), DispatchPattern=simplify(graft(null_24.InvalidFlags)))  # -> ListA, ListB
dispatch_71 = Dispatch(List=pln_79, DispatchPattern=null_24.InvalidFlags)  # -> ListA, ListB
pln_81 = Plane(dispatch_71.ListB)
pt_45 = Point(dispatch_70.ListB)

ccx_41 = CurveCurve(CurveA=graft(move_61.Geometry), CurveB=flatten(crv_67))  # -> Points, ParamsA, ParamsB
shift_19 = ShiftPaths(Data=ccx_41.Points, Offset=-1)
sort_55 = SortList(Keys=shift_19, ValuesA=shift_19)  # -> Keys, ValuesA
pull_47 = PullPoint(Point=sort_55.ValuesA, Geometry=graft(pln_79), ClosestOnly=True)  # -> ClosestPoint, Distance
sort_56 = SortList(Keys=pull_47.Distance, ValuesA=sort_55.ValuesA)  # -> Keys, ValuesA
item_73 = ListItem(List=sort_56.ValuesA, Index="-1", Wrap=True)
null_25 = NullItem(Item=flatten(item_73))  # -> NullFlags, InvalidFlags, Description
dispatch_72 = Dispatch(List=simplify(item_73), DispatchPattern=simplify(graft(null_25.InvalidFlags)))  # -> ListA, ListB
dispatch_73 = Dispatch(List=pln_79, DispatchPattern=null_25.InvalidFlags)  # -> ListA, ListB
pln_82 = Plane(dispatch_73.ListB)
pt_46 = Point(dispatch_72.ListB)

merge_27 = Merge(Data1=pln_82, Data2=pln_81)  # -> flatten(Result)
check_same_points_10 = CheckSamePoints(archPoint=flatten(pln_80), crvPoint=merge_27)  # -> out, specialPt; inputs archPoint: list of Point3d, crvPoint: list of Point3d; same code as testpoint

# ----
# 撞到结构
move2pt_35 = MoveToPoint(Geometry=flatten(pln_82), PointA=flatten(pln_82), PointB=flatten(pt_46))  # -> Moved, Vector, Transform
move2pt_36 = MoveToPoint(Geometry=flatten(pln_81), PointA=flatten(pln_81), PointB=flatten(pt_45))  # -> Moved, Vector, Transform

# ----
# pass
cull_i_20 = CullIndex(List=flatten(pln_80), Indices=check_same_points_10.specialPt, Wrap=True)  # -> simplify(graft(List))

# ----
# 3.2下层建筑内侧到300到外侧50内
# 无钢结构
# 要求主体结构提供钢结构梁，默认位置为建筑边线向内300mm
number_slider_38 = Slider(300, range=0..1000)
crv_68 = Curve(crv_24)
pln_83 = Plane(cull_i_20)
offset_15 = OffsetCurve(Curve=crv_68, Distance=expr("-x", number_slider_38), Corners=1)
pull_48 = PullPoint(Point=pln_83, Geometry=offset_15, ClosestOnly=True)  # -> ClosestPoint, Distance
sort_57 = SortList(Keys=pull_48.Distance)  # -> Keys, ValuesA
larger_13 = LargerThan(FirstNumber=pull_48.Distance, SecondNumber=Slider(400, range=0..1000))  # -> LargerThan, OrEqualTo
dispatch_74 = Dispatch(List=pln_83, DispatchPattern=larger_13.LargerThan)  # -> ListA, ListB
panel_57 = Panel(sort_57.Keys)
pln_84 = Plane(flatten(dispatch_74.ListB))
number_slider_39 = Slider(3584, range=0..10000)
deplane_45 = DeconstructPlane(Plane=pln_84)  # -> Origin, XAxis, YAxis, ZAxis
amp_54 = Amplitude(Vector=deplane_45.YAxis, Amplitude=number_slider_39)
amp_55 = Amplitude(Vector=deplane_45.YAxis, Amplitude=expr("-x", number_slider_39))
move_63 = Move(Geometry=deplane_45.Origin, Motion=amp_55)  # -> Geometry, Transform
move_64 = Move(Geometry=deplane_45.Origin, Motion=amp_54)  # -> Geometry, Transform
ln_64 = Line(StartPoint=move_63.Geometry, EndPoint=move_64.Geometry)
ccx_42 = CurveCurve(CurveA=ln_64, CurveB=offset_15)  # -> Points, ParamsA, ParamsB
null_26 = NullItem(Item=simplify(ccx_42.Points))  # -> NullFlags, InvalidFlags, Description
flatten_19 = FlattenTree(Tree=ccx_42.Points, Path="{0}")
dispatch_75 = Dispatch(List=simplify(graft(pln_84)), DispatchPattern=null_26.NullFlags)  # -> ListA, ListB
pull_49 = PullPoint(Point=deplane_45.Origin, Geometry=flatten_19, ClosestOnly=True)  # -> ClosestPoint, Distance

# ----
# 撞到结构
merge_28 = Merge(Data1=move2pt_35.Moved, Data2=move2pt_36.Moved)

# ----
# 可能的双点
pln_85 = Plane(dispatch_75.ListA)

# ----
# 离结构太远
pln_86 = Plane(dispatch_74.ListA)

merge_29 = Merge(Data1=pln_86, Data2=pln_85)

# ----
# 0 檐口出定位点
# 与结构无交点
pln_87 = Plane(flatten(merge_29))

# ----
# 3.2默认位置为建筑边线向内300mm
# 侧埋，钢板焊
# 03：钢板焊埋件[钢梁外侧]@钢边梁宽@钢边梁高
move2pt_37 = MoveToPoint(Geometry=pln_84, PointA=deplane_45.Origin, PointB=pull_49.ClosestPoint)  # -> Moved, Vector, Transform

# ----
# 3.2  Missing Point
# 埋件定位点Offset，没有找到和梁的交点
number_slider_40 = Slider(5000, range=0..10000)
crv_69 = Curve(scx_3.Curves)
deplane_46 = DeconstructPlane(Plane=pln_87)  # -> Origin, XAxis, YAxis, ZAxis
amp_56 = Amplitude(Vector=deplane_46.YAxis, Amplitude=number_slider_40)
move_65 = Move(Geometry=deplane_46.Origin, Motion=amp_56)  # -> Geometry, Transform
ln_65 = Line(StartPoint=move_65.Geometry, EndPoint=deplane_46.Origin)
amp_57 = Amplitude(Vector=deplane_46.XAxis, Amplitude=number_slider_7)
amp_58 = Amplitude(Vector=deplane_46.XAxis, Amplitude=expr("-x", number_slider_7))
move_66 = Move(Geometry=ln_65, Motion=amp_57)  # -> Geometry, Transform
move_67 = Move(Geometry=ln_65, Motion=amp_58)  # -> Geometry, Transform
pln_88 = Plane(pln_87)

ccx_43 = CurveCurve(CurveA=graft(move_67.Geometry), CurveB=flatten(crv_69))  # -> Points, ParamsA, ParamsB
shift_20 = ShiftPaths(Data=ccx_43.Points, Offset=-1)
sort_58 = SortList(Keys=shift_20, ValuesA=shift_20)  # -> Keys, ValuesA
pull_50 = PullPoint(Point=sort_58.ValuesA, Geometry=graft(pln_87), ClosestOnly=True)  # -> ClosestPoint, Distance
sort_59 = SortList(Keys=pull_50.Distance, ValuesA=sort_58.ValuesA)  # -> Keys, ValuesA
item_74 = ListItem(List=sort_59.ValuesA, Index="-1", Wrap=True)
null_27 = NullItem(Item=flatten(item_74))  # -> NullFlags, InvalidFlags, Description
dispatch_76 = Dispatch(List=simplify(item_74), DispatchPattern=simplify(graft(null_27.InvalidFlags)))  # -> ListA, ListB
dispatch_77 = Dispatch(List=pln_87, DispatchPattern=null_27.InvalidFlags)  # -> ListA, ListB
pln_89 = Plane(dispatch_77.ListB)
pt_47 = Point(dispatch_76.ListB)

ccx_44 = CurveCurve(CurveA=graft(move_66.Geometry), CurveB=flatten(crv_69))  # -> Points, ParamsA, ParamsB
shift_21 = ShiftPaths(Data=ccx_44.Points, Offset=-1)
sort_60 = SortList(Keys=shift_21, ValuesA=shift_21)  # -> Keys, ValuesA
pull_51 = PullPoint(Point=sort_60.ValuesA, Geometry=graft(pln_87), ClosestOnly=True)  # -> ClosestPoint, Distance
sort_61 = SortList(Keys=pull_51.Distance, ValuesA=sort_60.ValuesA)  # -> Keys, ValuesA
item_75 = ListItem(List=sort_61.ValuesA, Index="-1", Wrap=True)
null_28 = NullItem(Item=flatten(item_75))  # -> NullFlags, InvalidFlags, Description
dispatch_78 = Dispatch(List=simplify(item_75), DispatchPattern=simplify(graft(null_28.InvalidFlags)))  # -> ListA, ListB
dispatch_79 = Dispatch(List=pln_87, DispatchPattern=null_28.InvalidFlags)  # -> ListA, ListB
pln_90 = Plane(dispatch_79.ListB)
pt_48 = Point(dispatch_78.ListB)

merge_30 = Merge(Data1=pln_90, Data2=pln_89)  # -> flatten(Result)
check_same_points_11 = CheckSamePoints(archPoint=flatten(pln_88), crvPoint=merge_30)  # -> out, specialPt; inputs archPoint: list of Point3d, crvPoint: list of Point3d; same code as testpoint

# ----
# 撞到结构
move2pt_38 = MoveToPoint(Geometry=flatten(pln_90), PointA=flatten(pln_90), PointB=flatten(pt_48))  # -> Moved, Vector, Transform
move2pt_39 = MoveToPoint(Geometry=flatten(pln_89), PointA=flatten(pln_89), PointB=flatten(pt_47))  # -> Moved, Vector, Transform

# ----
# pass
cull_i_21 = CullIndex(List=flatten(pln_88), Indices=check_same_points_11.specialPt, Wrap=True)  # -> simplify(graft(List))

# ----
# 撞到结构
merge_31 = Merge(Data1=move2pt_38.Moved, Data2=move2pt_39.Moved)

# ----
# 3.3  Missing Point
# 埋件定位点Offset，没有找到和梁的交点
number_slider_41 = Slider(5000, range=0..10000)
deplane_47 = DeconstructPlane(Plane=pln_51)  # -> Origin, XAxis, YAxis, ZAxis
crv_70 = Curve(crv_58)
amp_59 = Amplitude(Vector=deplane_47.YAxis, Amplitude=number_slider_41)
move_68 = Move(Geometry=deplane_47.Origin, Motion=amp_59)  # -> Geometry, Transform
ln_66 = Line(StartPoint=move_68.Geometry, EndPoint=deplane_47.Origin)
amp_60 = Amplitude(Vector=deplane_47.XAxis, Amplitude=number_slider_7)
amp_61 = Amplitude(Vector=deplane_47.XAxis, Amplitude=expr("-x", number_slider_7))
move_69 = Move(Geometry=ln_66, Motion=amp_60)  # -> Geometry, Transform
move_70 = Move(Geometry=ln_66, Motion=amp_61)  # -> Geometry, Transform
pln_91 = Plane(pln_51)

ccx_45 = CurveCurve(CurveA=graft(move_70.Geometry), CurveB=flatten(crv_70))  # -> Points, ParamsA, ParamsB
shift_22 = ShiftPaths(Data=ccx_45.Points, Offset=-1)
sort_62 = SortList(Keys=shift_22, ValuesA=shift_22)  # -> Keys, ValuesA
pull_52 = PullPoint(Point=sort_62.ValuesA, Geometry=graft(pln_51), ClosestOnly=True)  # -> ClosestPoint, Distance
sort_63 = SortList(Keys=pull_52.Distance, ValuesA=sort_62.ValuesA)  # -> Keys, ValuesA
item_76 = ListItem(List=sort_63.ValuesA, Index="-1", Wrap=True)
null_29 = NullItem(Item=flatten(item_76))  # -> NullFlags, InvalidFlags, Description
dispatch_80 = Dispatch(List=simplify(item_76), DispatchPattern=simplify(graft(null_29.InvalidFlags)))  # -> ListA, ListB
dispatch_81 = Dispatch(List=pln_51, DispatchPattern=null_29.InvalidFlags)  # -> ListA, ListB
pln_92 = Plane(dispatch_81.ListB)
pt_49 = Point(dispatch_80.ListB)

ccx_46 = CurveCurve(CurveA=graft(move_69.Geometry), CurveB=flatten(crv_70))  # -> Points, ParamsA, ParamsB
shift_23 = ShiftPaths(Data=ccx_46.Points, Offset=-1)
sort_64 = SortList(Keys=shift_23, ValuesA=shift_23)  # -> Keys, ValuesA
pull_53 = PullPoint(Point=sort_64.ValuesA, Geometry=graft(pln_51), ClosestOnly=True)  # -> ClosestPoint, Distance
sort_65 = SortList(Keys=pull_53.Distance, ValuesA=sort_64.ValuesA)  # -> Keys, ValuesA
item_77 = ListItem(List=sort_65.ValuesA, Index="-1", Wrap=True)
null_30 = NullItem(Item=flatten(item_77))  # -> NullFlags, InvalidFlags, Description
dispatch_82 = Dispatch(List=simplify(item_77), DispatchPattern=simplify(graft(null_30.InvalidFlags)))  # -> ListA, ListB
dispatch_83 = Dispatch(List=pln_51, DispatchPattern=null_30.InvalidFlags)  # -> ListA, ListB
pln_93 = Plane(dispatch_83.ListB)
pt_50 = Point(dispatch_82.ListB)

merge_32 = Merge(Data1=pln_93, Data2=pln_92)  # -> flatten(Result)
check_same_points_12 = CheckSamePoints(archPoint=flatten(pln_91), crvPoint=merge_32)  # -> out, specialPt; inputs archPoint: list of Point3d, crvPoint: list of Point3d; same code as testpoint

# ----
# 撞到结构
move2pt_40 = MoveToPoint(Geometry=flatten(pln_93), PointA=flatten(pln_93), PointB=flatten(pt_50))  # -> Moved, Vector, Transform
move2pt_41 = MoveToPoint(Geometry=flatten(pln_92), PointA=flatten(pln_92), PointB=flatten(pt_49))  # -> Moved, Vector, Transform

# ----
# pass
cull_i_22 = CullIndex(List=flatten(pln_91), Indices=check_same_points_12.specialPt, Wrap=True)  # -> simplify(graft(List))

# ----
# 撞到结构
merge_33 = Merge(Data1=move2pt_40.Moved, Data2=move2pt_41.Moved)

# ==== cluster Cluster
G = ClusterInput()
rotate = Rotate(Geometry=G, Angle=3.141592654, Plane=PlaneXY(0, 0, 0))  # -> Geometry, Transform
boxprop = BoxProperties(Box=rotate.Geometry)  # -> Center, Diagonal, Area, Volume, Degeneracy
bbox = BoundingBox(Content=rotate.Geometry, Plane=PlaneXY(0, 0, 0))  # -> Box, Box_2
debox = DeconstructBox(Box=bbox.Box)  # -> Plane, X, Y, Z
pdecon = Deconstruct(Point=boxprop.Center)  # -> XComponent, YComponent, ZComponent
dedomain = DeconstructDomain(Domain=debox.Y)  # -> Start, End
pt = ConstructPoint(XCoordinate=pdecon.XComponent, YCoordinate=dedomain.Start, ZCoordinate=pdecon.ZComponent)
xy = XYPlane(Origin=Point(0, 0, 0))
pl_origin = PlaneOrigin(Base=xy, Origin=pt)
orient = Orient(Geometry=rotate.Geometry, Source=pl_origin, Target=xy)  # -> Geometry, Transform
G_2 = ClusterOutput(orient.Geometry)
